# Grasshopper definition Grasshopper Post.gh (Grasshopper 1.0.8)

number_slider = Slider(250, range=0..1000)
rectangle = Rectangle(Plane=PlaneXY(0, 0, 0), XSize=Slider(500, range=0..1000), YSize=Slider(500, range=0..1000), Radius=0)  # -> Rectangle, Length
X = UnitX(Factor=number_slider)
Y = UnitY(Factor=number_slider)
move = Move(Geometry=rectangle.Rectangle, Motion=Y)  # -> Geometry, Transform
move_2 = Move(Geometry=move.Geometry, Motion=X)  # -> Geometry, Transform

crv = Curve(<curve referenced from the Rhino model>)

# ----
# 2D contour cutting
c_script = CSharpScript(
    curve=crv,
    depth=Slider(0, range=0..10),
    toolNr=Slider(10, range=0..10),
    toolDiameter=Slider(50, range=0..50),
    side=Slider(-1, range=-1..1))  # -> operationLines; inputs curve: Curve, depth: Double, plungeZ: Double, tolerance: Double, toolNr: Int32, toolDiameter: Double, side: Int32, stepdown: Double, colour: Color
# ---------- c_script: C# ----------
// HopContour -- 2D contour cutting component for DYNESTIC CNC
// Inputs: curve (Item), depth (Item), plungeZ (Item), tolerance (Item),
//         toolNr (Item), toolDiameter (Item), side (Item), stepdown (Item), colour (Item)
// Outputs: operationLines
//
// side: -1 = left of travel direction (inside cut)
//        0 = center (tool center on curve, no offset)
//       +1 = right of travel direction (outside cut)
//
// When side != 0, the curve is geometrically pre-offset by toolDiameter/2
// before building the SP/G01/G03M blocks. The machine receives the offset path.
// Preview shows the actual material-removal volume on the chosen side.
//
// toolType and feedFactor hardcoded (WZF / 1.0) -- handled at machine level.

using System;
using System.Collections;
using System.Collections.Generic;
using System.Drawing;
using System.Globalization;

using Rhino;
using Rhino.Geometry;

using Grasshopper;
using Grasshopper.Kernel;
using Grasshopper.Kernel.Data;
using Grasshopper.Kernel.Types;

public class Script_Instance : GH_ScriptInstance
{
  // ---------------------------------------------------------------
  // PREVIEW FIELDS
  // ---------------------------------------------------------------
  private static readonly Color _defaultColor = Color.Yellow;
  private Brep  _previewVolume = null;
  private Line  _approachLine  = Line.Unset;
  private Color _drawColor     = Color.Yellow;

  public override BoundingBox ClippingBox
  {
    get
    {
      BoundingBox bb = BoundingBox.Empty;
      if (_previewVolume != null) bb.Union(_previewVolume.GetBoundingBox(true));
      if (_approachLine.IsValid)  { bb.Union(_approachLine.From); bb.Union(_approachLine.To); }
      return bb;
    }
  }

  public override void DrawViewportMeshes(IGH_PreviewArgs args)
  {
    if (_previewVolume != null)
    {
      Rhino.Display.DisplayMaterial mat = new Rhino.Display.DisplayMaterial(_drawColor);
      mat.Transparency = 0.5;
      args.Display.DrawBrepShaded(_previewVolume, mat);
    }
  }

  public override void DrawViewportWires(IGH_PreviewArgs args)
  {
    if (_previewVolume != null)
      args.Display.DrawBrepWires(_previewVolume, _drawColor, 1);
    if (_approachLine.IsValid)
      args.Display.DrawPatternedLine(
        _approachLine.From, _approachLine.To,
        Color.FromArgb(140, 140, 140), unchecked((int)0xF0F0F0F0), 1);
  }

  private void RunScript(
		Curve curve,
		double depth,
		double plungeZ,
		double tolerance,
		int toolNr,
		double toolDiameter,
		int side,
		double stepdown,
		Color colour,
		ref object operationLines)
  {
    string toolType   = "WZF";
    double feedFactor = 1.0;

    _previewVolume = null;
    _approachLine  = Line.Unset;
    _drawColor     = colour.IsEmpty ? _defaultColor : colour;

    // ---------------------------------------------------------------
    // 1. DEFAULTS
    // ---------------------------------------------------------------
    operationLines = new List<string>();

    // ---------------------------------------------------------------
    // 2. GUARDS
    // ---------------------------------------------------------------
    if (curve == null)
    {
      this.Component.AddRuntimeMessage(GH_RuntimeMessageLevel.Error, "No curve connected");
      return;
    }
    if (toolNr <= 0)
    {
      this.Component.AddRuntimeMessage(GH_RuntimeMessageLevel.Error,
        "toolNr must be > 0");
      return;
    }

    // ---------------------------------------------------------------
    // 3. INPUT DEFAULTS
    // ---------------------------------------------------------------
    if (tolerance    <= 0) tolerance    = 0.1;
    if (depth        <= 0) depth        = 1.0;
    if (plungeZ      <= 0) plungeZ      = depth;
    if (toolDiameter <= 0) toolDiameter = 8.0;
    // side: clamp to -1 / 0 / +1
    if (side > 0)  side =  1;
    if (side < 0)  side = -1;

    // ---------------------------------------------------------------
    // 4. PLANARITY CHECK
    // ---------------------------------------------------------------
    if (!curve.IsPlanar())
    {
      this.Component.AddRuntimeMessage(GH_RuntimeMessageLevel.Error,
        "Curve is not planar -- cannot use for 2D contour");
      return;
    }

    // ---------------------------------------------------------------
    // 5. GEOMETRIC PRE-OFFSET (when side != 0)
    //    Offset the input curve by toolDiameter/2 in the chosen direction.
    //    The machine receives the offset path -- tool center tracks it exactly.
    //    side = -1 (left / inside):  positive offset distance in Rhino convention
    //    side = +1 (right / outside): negative offset distance
    //    Note: Rhino Curve.Offset with positive distance offsets to the LEFT
    //    of the curve direction. Negate for right.
    // ---------------------------------------------------------------
    double tol    = RhinoDoc.ActiveDoc != null ? RhinoDoc.ActiveDoc.ModelAbsoluteTolerance : 0.01;
    double radius = toolDiameter / 2.0;

    Curve cuttingCurve = curve;  // curve actually sent to machine

    if (side != 0)
    {
      double offsetDist = side * radius;  // -1*r = left offset, +1*r = right offset
      Curve[] offsets = curve.Offset(Plane.WorldXY, offsetDist, tol,
        CurveOffsetCornerStyle.Sharp);
      if (offsets != null && offsets.Length > 0)
      {
        cuttingCurve = offsets.Length == 1 ? offsets[0]
          : Curve.JoinCurves(offsets, tol)[0];
      }
      else
      {
        this.Component.AddRuntimeMessage(GH_RuntimeMessageLevel.Warning,
          "Side offset failed -- using center path");
      }
    }

    // ---------------------------------------------------------------
    // 6. PREVIEW VOLUME
    //    Show the material-removal channel on the chosen side.
    //    side = 0: symmetric channel (toolDiameter wide)
    //    side != 0: one-sided strip between original curve and offset curve
    // ---------------------------------------------------------------
    double cutZ = -Math.Abs(plungeZ > 0 ? plungeZ : depth);

    Curve baseCrv = curve.DuplicateCurve();
    baseCrv.Translate(new Vector3d(0, 0, cutZ - baseCrv.PointAtStart.Z));

    Curve cuttingBase = cuttingCurve.DuplicateCurve();
    cuttingBase.Translate(new Vector3d(0, 0, cutZ - cuttingBase.PointAtStart.Z));

    Curve innerBoundary;
    Curve outerBoundary;

    if (side == 0)
    {
      // Symmetric channel: offset both sides of original curve
      Curve[] outerArr = baseCrv.Offset(Plane.WorldXY,  radius, tol, CurveOffsetCornerStyle.Sharp);
      Curve[] innerArr = baseCrv.Offset(Plane.WorldXY, -radius, tol, CurveOffsetCornerStyle.Sharp);
      outerBoundary = (outerArr != null && outerArr.Length > 0) ? outerArr[0] : null;
      innerBoundary = (innerArr != null && innerArr.Length > 0) ? innerArr[0] : null;
    }
    else
    {
      // One-sided: between original curve and offset curve
      outerBoundary = baseCrv;
      innerBoundary = cuttingBase;
    }

    if (outerBoundary != null && innerBoundary != null)
    {
      Brep[] planar = Brep.CreatePlanarBreps(
        new Curve[] { outerBoundary, innerBoundary }, tol);
      if (planar != null && planar.Length > 0)
      {
        // CreateExtrusion takes a path Curve, not a Vector3d
        Vector3d extDir  = new Vector3d(0, 0, -Math.Abs(depth));
        LineCurve extPath = new LineCurve(new Line(Point3d.Origin, Point3d.Origin + extDir));
        Brep vol = planar[0].Faces[0].CreateExtrusion(extPath, true);
        if (vol != null) _previewVolume = vol;
      }
    }

    // Dashed approach line
    BoundingBox curveBB = curve.GetBoundingBox(true);
    double safeZ   = curveBB.Max.Z + 20.0;
    Point3d startP = cuttingBase.PointAtStart;
    _approachLine  = new Line(new Point3d(startP.X, startP.Y, safeZ), startP);

    // ---------------------------------------------------------------
    // 7. CURVE DECOMPOSITION on cuttingCurve (offset or original)
    // ---------------------------------------------------------------
    PolyCurve pc = cuttingCurve.ToArcsAndLines(tolerance, 0.1, 0.0, 0.0) as PolyCurve;
    if (pc == null)
    {
      this.Component.AddRuntimeMessage(GH_RuntimeMessageLevel.Error,
        "Curve conversion to arcs and lines failed");
      return;
    }

    // ---------------------------------------------------------------
    // 8. BUILD NC OUTPUT
    // ---------------------------------------------------------------
    List<string> lines = new List<string>();
    lines.Add(toolType + " (" + toolNr.ToString()
      + ",_VE,_V*" + feedFactor.ToString(CultureInfo.InvariantCulture)
      + ",_VA,_SD,0,'')");

    if (stepdown > 0)
    {
      int passCount = (int)Math.Ceiling(depth / stepdown);
      for (int p = 0; p < passCount; p++)
      {
        double passDepth = Math.Min((p + 1) * stepdown, depth);
        BuildContourBlock(lines, pc, -Math.Abs(passDepth));
      }
    }
    else
    {
      BuildContourBlock(lines, pc, -Math.Abs(plungeZ));
    }

    // ---------------------------------------------------------------
    // 9. REMARK + OUTPUT
    // ---------------------------------------------------------------
    string sideLabel = side == 0 ? "center" : (side < 0 ? "left (inside)" : "right (outside)");
    this.Component.AddRuntimeMessage(GH_RuntimeMessageLevel.Remark,
      "Contour: " + pc.SegmentCount.ToString() + " segments"
      + "  depth=" + (-Math.Abs(depth)).ToString(CultureInfo.InvariantCulture)
      + "  side=" + sideLabel
      + "  toolD=" + toolDiameter.ToString(CultureInfo.InvariantCulture));

    operationLines = lines;
  }

  // ---------------------------------------------------------------
  // HELPER: Build one SP...moves...EP contour block
  // ---------------------------------------------------------------
  private void BuildContourBlock(List<string> lines, PolyCurve pc, double zEintauch)
  {
    Point3d startPt = pc.PointAtStart;
    lines.Add("SP (" + startPt.X.ToString(CultureInfo.InvariantCulture) + ","
      + startPt.Y.ToString(CultureInfo.InvariantCulture) + ","
      + zEintauch.ToString(CultureInfo.InvariantCulture)
      + ",2,0,_ANF,0,0,0,0,0,0,0,0,0,0,0,0,0,0,0,0,0)");

    for (int i = 0; i < pc.SegmentCount; i++)
    {
      Curve seg = pc.SegmentCurve(i);

      ArcCurve arcSeg = seg as ArcCurve;
      if (arcSeg != null)
      {
        Arc arc    = arcSeg.Arc;
        Point3d ep = arc.EndPoint;
        Point3d cp = arc.Center;
        bool isCCW = arc.Plane.Normal.Z >= 0;
        string cmd = isCCW ? "G03M" : "G02M";
        lines.Add(cmd + " ("
          + ep.X.ToString(CultureInfo.InvariantCulture) + ","
          + ep.Y.ToString(CultureInfo.InvariantCulture) + ",0,"
          + cp.X.ToString(CultureInfo.InvariantCulture) + ","
          + cp.Y.ToString(CultureInfo.InvariantCulture) + ",0,0,2,0)");
        continue;
      }

      LineCurve lineSeg = seg as LineCurve;
      if (lineSeg != null)
      {
        Point3d ep = lineSeg.PointAtEnd;
        lines.Add("G01 ("
          + ep.X.ToString(CultureInfo.InvariantCulture) + ","
          + ep.Y.ToString(CultureInfo.InvariantCulture) + ",0,0,0,2)");
        continue;
      }

      Point3d fallback = seg.PointAtEnd;
      lines.Add("G01 ("
        + fallback.X.ToString(CultureInfo.InvariantCulture) + ","
        + fallback.Y.ToString(CultureInfo.InvariantCulture) + ",0,0,0,2)");
    }

    lines.Add("EP (0,_ANF,0)");
  }
}
# ---------- end c_script ----------

# ----
# Rectangular pocket
c_script_2 = CSharpScript(
    rectCurve=move_2.Geometry,
    cornerRadius=Slider(100, range=0..100),
    depth=Slider(10, range=0..10),
    toolNr=Slider(10, range=0..10))  # -> operationLines; inputs rectCurve: Curve, cornerRadius: Double, angle: Double, depth: Double, stepdown: Double, toolNr: Int32, colour: Color
# ---------- c_script_2: C# ----------
// HopRectPocket -- Rectangular pocket operation for DYNESTIC CNC
// Inputs: rectCurve (Item), cornerRadius (Item), angle (Item),
//         depth (Item), stepdown (Item),
//         toolNr (Item), colour (Item)
// Outputs: operationLines
//
// Extracts center and dimensions from the rectangle curve bounding box.
// Emits WZF tool call + CALL _RechteckTasche_V5 macro for HopExport.
// toolType and feedFactor are hardcoded (WZF / 1.0) -- handled at machine level.

using System;
using System.Collections;
using System.Collections.Generic;
using System.Drawing;
using System.Globalization;

using Rhino;
using Rhino.Geometry;

using Grasshopper;
using Grasshopper.Kernel;
using Grasshopper.Kernel.Data;
using Grasshopper.Kernel.Types;

public class Script_Instance : GH_ScriptInstance
{
  // ---------------------------------------------------------------
  // PREVIEW FIELDS
  // ---------------------------------------------------------------
  private static readonly Color _defaultColor = Color.Cyan;
  private Brep  _previewVolume = null;
  private Line  _approachLine  = Line.Unset;
  private Color _drawColor     = Color.Cyan;

  public override BoundingBox ClippingBox
  {
    get
    {
      BoundingBox bb = BoundingBox.Empty;
      if (_previewVolume != null) bb.Union(_previewVolume.GetBoundingBox(true));
      if (_approachLine.IsValid) { bb.Union(_approachLine.From); bb.Union(_approachLine.To); }
      return bb;
    }
  }

  public override void DrawViewportMeshes(IGH_PreviewArgs args)
  {
    if (_previewVolume != null)
    {
      Rhino.Display.DisplayMaterial mat = new Rhino.Display.DisplayMaterial(_drawColor);
      mat.Transparency = 0.55;
      args.Display.DrawBrepShaded(_previewVolume, mat);
    }
  }

  public override void DrawViewportWires(IGH_PreviewArgs args)
  {
    if (_previewVolume != null)
      args.Display.DrawBrepWires(_previewVolume, _drawColor, 1);
    if (_approachLine.IsValid)
      args.Display.DrawPatternedLine(
        _approachLine.From, _approachLine.To,
        Color.FromArgb(140, 140, 140), unchecked((int)0xF0F0F0F0), 1);
  }

  private void RunScript(
		Curve rectCurve,
		double cornerRadius,
		double angle,
		double depth,
		double stepdown,
		int toolNr,
		Color colour,
		ref object operationLines)
  {
    // Hardcoded tool params -- handled at machine level
    string toolType   = "WZF";
    double feedFactor = 1.0;

    // PREVIEW: clear fields first (before guards) so disconnecting inputs wipes stale geometry
    _previewVolume = null;
    _approachLine  = Line.Unset;
    _drawColor     = colour.IsEmpty ? _defaultColor : colour;

    // ---------------------------------------------------------------
    // 1. DEFAULTS
    // ---------------------------------------------------------------
    operationLines = new List<string>();

    // ---------------------------------------------------------------
    // 2. GUARDS
    // ---------------------------------------------------------------
    if (rectCurve == null)
    {
      this.Component.AddRuntimeMessage(
        GH_RuntimeMessageLevel.Error, "No rectangle curve connected");
      return;
    }

    if (toolNr <= 0)
    {
      this.Component.AddRuntimeMessage(
        GH_RuntimeMessageLevel.Error, "toolNr is required and must be > 0");
      return;
    }

    // ---------------------------------------------------------------
    // 3. INPUT DEFAULTS
    // ---------------------------------------------------------------
    if (cornerRadius < 0) cornerRadius = 0;
    if (depth <= 0) depth = 1.0;

    // ---------------------------------------------------------------
    // 4. EXTRACT DIMENSIONS from BoundingBox
    // ---------------------------------------------------------------
    BoundingBox bb = rectCurve.GetBoundingBox(true);
    double cx = (bb.Min.X + bb.Max.X) / 2.0;
    double cy = (bb.Min.Y + bb.Max.Y) / 2.0;
    double width  = bb.Max.X - bb.Min.X;
    double height = bb.Max.Y - bb.Min.Y;

    // PREVIEW: box from bounding rect at surface down to -depth
    double tol = RhinoDoc.ActiveDoc != null ? RhinoDoc.ActiveDoc.ModelAbsoluteTolerance : 0.01;
    double topZ  = bb.Max.Z;
    double botZ  = topZ - Math.Abs(depth);

    // Build rotated box: create base rect at topZ, extrude down
    double previewZ = topZ;
    Rectangle3d previewBounds = new Rectangle3d(
      new Plane(new Point3d(cx, cy, previewZ), Vector3d.XAxis, Vector3d.YAxis),
      new Interval(-width / 2.0, width / 2.0),
      new Interval(-height / 2.0, height / 2.0));
    Curve baseCurve = previewBounds.ToNurbsCurve();

    if (cornerRadius > 0)
    {
      Curve filleted = Curve.CreateFilletCornersCurve(baseCurve, cornerRadius, 1e-6, 1e-6);
      if (filleted != null) baseCurve = filleted;
    }

    if (angle != 0)
    {
      double angleRad = angle * Math.PI / 180.0;
      Point3d centerPoint = new Point3d(cx, cy, previewZ);
      baseCurve.Transform(Transform.Rotation(angleRad, Vector3d.ZAxis, centerPoint));
    }

    // Extrude the closed base curve downward
    if (baseCurve.IsClosed)
    {
      Vector3d extDir = new Vector3d(0, 0, -(topZ - botZ));
      Surface extSrf = Surface.CreateExtrusion(baseCurve, extDir);
      if (extSrf != null)
      {
        Brep extBrep = extSrf.ToBrep();
        if (extBrep != null)
        {
          Brep capped = extBrep.CapPlanarHoles(tol);
          _previewVolume = capped != null ? capped : extBrep;
        }
      }
    }

    // PREVIEW: approach line from safeZ to bottom-left corner
    double safeZ = rectCurve.GetBoundingBox(true).Max.Z + 20.0;
    Point3d startPt = new Point3d(bb.Min.X, bb.Min.Y, topZ);
    _approachLine = new Line(new Point3d(startPt.X, startPt.Y, safeZ), startPt);

    // ---------------------------------------------------------------
    // 5. BUILD TOOL CALL (first line)
    // ---------------------------------------------------------------
    List<string> lines = new List<string>();
    string toolCall = toolType + " (" + toolNr.ToString()
      + ",_VE,_V*" + feedFactor.ToString(CultureInfo.InvariantCulture)
      + ",_VA,_SD,0,'')";
    lines.Add(toolCall);

    // ---------------------------------------------------------------
    // 6. BUILD CALL MACRO
    // ---------------------------------------------------------------
    double negDepth   = -Math.Abs(depth);
    double zustellung = (stepdown > 0) ? stepdown : 0;

    lines.Add("CALL _RechteckTasche_V5(VAL "
      + "x_Mitte:=" + cx.ToString(CultureInfo.InvariantCulture) + ","
      + "Y_Mitte:=" + cy.ToString(CultureInfo.InvariantCulture) + ","
      + "Taschenlaenge:=" + width.ToString(CultureInfo.InvariantCulture) + ","
      + "Taschenbreite:=" + height.ToString(CultureInfo.InvariantCulture) + ","
      + "Radius:=" + cornerRadius.ToString(CultureInfo.InvariantCulture) + ","
      + "Winkel:=" + angle.ToString(CultureInfo.InvariantCulture) + ","
      + "Tiefe:=" + negDepth.ToString(CultureInfo.InvariantCulture) + ","
      + "Zustellung:=" + zustellung.ToString(CultureInfo.InvariantCulture) + ","
      + "AB:=2,ABF:=_ANF,Interpol:=1,umkehren:=0,esxy:=0,esmd:=0,laser:=0)");

    // ---------------------------------------------------------------
    // 7. OUTPUT
    // ---------------------------------------------------------------
    this.Component.AddRuntimeMessage(
      GH_RuntimeMessageLevel.Remark,
      "RectPocket: " + width.ToString(CultureInfo.InvariantCulture)
      + " x " + height.ToString(CultureInfo.InvariantCulture)
      + " at (" + cx.ToString(CultureInfo.InvariantCulture)
      + ", " + cy.ToString(CultureInfo.InvariantCulture) + ")");

    operationLines = lines;
  }
}
# ---------- end c_script_2 ----------

number_slider_2 = Slider(0, range=0..1000)

Z = UnitZ(Factor=Slider(19, range=0..100))
rectangle_2 = Rectangle(Plane=PlaneXY(0, 0, 0), XSize=Slider(1000, range=0..1000), YSize=Slider(1000, range=0..1000), Radius=0)  # -> Rectangle, Length

neg = Negative(Value=Z)

extr = Extrude(Base=rectangle_2.Rectangle, Direction=neg)
cap = CapHoles(Brep=extr)

neg_2 = Negative(Value=Slider(25, range=0..100))
offset = OffsetCurve(Curve=rectangle_2.Rectangle, Distance=neg_2, Corners=1)
cpoly = ControlPolygon(Curve=offset)  # -> Polygon, Points

area = Area(Geometry=rectangle_2.Rectangle)  # -> Area, Centroid

# ----
# Circular profile path
c_script_3 = CSharpScript(
    center=area.Centroid,
    radius=Slider(100, range=0..100),
    radiusCorr=Slider(86, range=0..100),
    depth=Slider(19, range=0..100),
    toolNr=Slider(19, range=0..100))  # -> operationLines; inputs center: Point3d, radius: Double, radiusCorr: Int32, depth: Double, stepdown: Double, angle: Double, toolNr: Int32, colour: Color
# ---------- c_script_3: C# ----------
// HopCircPath -- Circular profile path operation for DYNESTIC CNC
// Inputs: center (Item), radius (Item), radiusCorr (Item),
//         depth (Item), stepdown (Item), angle (Item),
//         toolNr (Item), colour (Item)
// Outputs: operationLines
//
// radiusCorr: 1 = inside, -1 = outside, 0 = center
// Emits WZF tool call + CALL _Kreisbahn_V5 macro for HopExport.
// toolType and feedFactor are hardcoded (WZF / 1.0) -- handled at machine level.

using System;
using System.Collections;
using System.Collections.Generic;
using System.Drawing;
using System.Globalization;

using Rhino;
using Rhino.Geometry;

using Grasshopper;
using Grasshopper.Kernel;
using Grasshopper.Kernel.Data;
using Grasshopper.Kernel.Types;

public class Script_Instance : GH_ScriptInstance
{
  // ---------------------------------------------------------------
  // PREVIEW FIELDS
  // ---------------------------------------------------------------
  private static readonly Color _defaultColor = Color.LimeGreen;
  private Brep  _previewVolume = null;
  private Line  _approachLine  = Line.Unset;
  private Color _drawColor     = Color.LimeGreen;

  public override BoundingBox ClippingBox
  {
    get
    {
      BoundingBox bb = BoundingBox.Empty;
      if (_previewVolume != null) bb.Union(_previewVolume.GetBoundingBox(true));
      if (_approachLine.IsValid) { bb.Union(_approachLine.From); bb.Union(_approachLine.To); }
      return bb;
    }
  }

  public override void DrawViewportMeshes(IGH_PreviewArgs args)
  {
    if (_previewVolume != null)
    {
      Rhino.Display.DisplayMaterial mat = new Rhino.Display.DisplayMaterial(_drawColor);
      mat.Transparency = 0.55;
      args.Display.DrawBrepShaded(_previewVolume, mat);
    }
  }

  public override void DrawViewportWires(IGH_PreviewArgs args)
  {
    if (_previewVolume != null)
      args.Display.DrawBrepWires(_previewVolume, _drawColor, 1);
    if (_approachLine.IsValid)
      args.Display.DrawPatternedLine(
        _approachLine.From, _approachLine.To,
        Color.FromArgb(140, 140, 140), unchecked((int)0xF0F0F0F0), 1);
  }

  private void RunScript(
		Point3d center,
		double radius,
		int radiusCorr,
		double depth,
		double stepdown,
		double angle,
		int toolNr,
		Color colour,
		ref object operationLines)
  {
    // Hardcoded tool params -- handled at machine level
    string toolType   = "WZF";
    double feedFactor = 1.0;

    // PREVIEW: clear fields first (before guards) so disconnecting inputs wipes stale geometry
    _previewVolume = null;
    _approachLine  = Line.Unset;
    _drawColor     = colour.IsEmpty ? _defaultColor : colour;

    // ---------------------------------------------------------------
    // 1. DEFAULTS
    // ---------------------------------------------------------------
    operationLines = new List<string>();

    // ---------------------------------------------------------------
    // 2. GUARDS
    // ---------------------------------------------------------------
    if (toolNr <= 0)
    {
      this.Component.AddRuntimeMessage(
        GH_RuntimeMessageLevel.Error, "toolNr is required and must be > 0");
      return;
    }

    if (radius <= 0)
    {
      this.Component.AddRuntimeMessage(
        GH_RuntimeMessageLevel.Error, "radius must be > 0");
      return;
    }

    // ---------------------------------------------------------------
    // 3. INPUT DEFAULTS
    // ---------------------------------------------------------------
    if (depth <= 0) depth = 1.0;
    if (angle <= 0) angle = 360.0;

    // PREVIEW: cylinder at the circular path -- extrude the path circle downward by depth
    // The path circle sits at center.Z; extrude it downward to show the cutting volume.
    double previewZ = center.Z;
    Point3d circlePt = new Point3d(center.X, center.Y, previewZ);
    Plane cylPlane = new Plane(circlePt, Vector3d.ZAxis);
    Circle pathCircle = new Circle(cylPlane, radius);
    // Build a thin cylindrical shell to represent the path (not a solid pocket)
    // Extrude the circle curve (as a closed NurbsCurve) downward
    Curve pathCurve = pathCircle.ToNurbsCurve();
    double tol = RhinoDoc.ActiveDoc != null ? RhinoDoc.ActiveDoc.ModelAbsoluteTolerance : 0.01;
    Vector3d extDir = new Vector3d(0, 0, -Math.Abs(depth));
    Surface extSrf = Surface.CreateExtrusion(pathCurve, extDir);
    if (extSrf != null)
    {
      Brep extBrep = extSrf.ToBrep();
      if (extBrep != null)
      {
        Brep capped = extBrep.CapPlanarHoles(tol);
        _previewVolume = capped != null ? capped : extBrep;
      }
    }

    // PREVIEW: approach line from safeZ to the 3 o'clock entry point
    double safeZ = center.Z + 20.0;
    Point3d entryPt = new Point3d(center.X + radius, center.Y, previewZ);
    _approachLine = new Line(new Point3d(entryPt.X, entryPt.Y, safeZ), entryPt);

    // ---------------------------------------------------------------
    // 4. BUILD TOOL CALL + MACRO
    // ---------------------------------------------------------------
    List<string> lines = new List<string>();
    lines.Add(toolType + " (" + toolNr.ToString()
      + ",_VE,_V*" + feedFactor.ToString(CultureInfo.InvariantCulture)
      + ",_VA,_SD,0,'')");

    double negDepth  = -Math.Abs(depth);
    double zuTiefe   = (stepdown > 0) ? stepdown : 0;

    lines.Add("CALL _Kreisbahn_V5(VAL "
      + "X_Mitte:=" + center.X.ToString(CultureInfo.InvariantCulture) + ","
      + "Y_Mitte:=" + center.Y.ToString(CultureInfo.InvariantCulture) + ","
      + "Tiefe:=" + negDepth.ToString(CultureInfo.InvariantCulture) + ","
      + "ZuTiefe:=" + zuTiefe.ToString(CultureInfo.InvariantCulture) + ","
      + "Radius:=" + radius.ToString(CultureInfo.InvariantCulture) + ","
      + "Radiuskorrektur:=" + radiusCorr.ToString() + ","
      + "AB:=1,Aufmass:=0,Bearb_umkehren:=1,"
      + "Winkel:=" + angle.ToString(CultureInfo.InvariantCulture) + ","
      + "ANF:=_ANF,ABF:=_ANF,Rampe:=1,Interpol:=0,esxy:=0,esmd:=0,laser:=0)");

    // ---------------------------------------------------------------
    // 5. OUTPUT
    // ---------------------------------------------------------------
    this.Component.AddRuntimeMessage(
      GH_RuntimeMessageLevel.Remark,
      "CircPath: R=" + radius.ToString(CultureInfo.InvariantCulture)
      + " corr=" + radiusCorr.ToString()
      + " angle=" + angle.ToString(CultureInfo.InvariantCulture));

    operationLines = lines;
  }
}
# ---------- end c_script_3 ----------

# ----
# Circular pocket
c_script_4 = CSharpScript(
    center=area.Centroid,
    radius=Slider(15, range=0..100),
    depth=Slider(40, range=0..100),
    stepdown=Slider(3, range=0..100),
    toolNr=Slider(19, range=0..100))  # -> operationLines; inputs center: Point3d, radius: Double, depth: Double, stepdown: Double, toolNr: Int32, colour: Color
# ---------- c_script_4: C# ----------
// HopCircPocket -- Circular pocket operation for DYNESTIC CNC
// Inputs: center (Item), radius (Item),
//         depth (Item), stepdown (Item),
//         toolNr (Item), colour (Item)
// Outputs: operationLines
//
// Emits WZF tool call + CALL _Kreistasche_V5 macro for HopExport.
// toolType and feedFactor are hardcoded (WZF / 1.0) -- handled at machine level.

using System;
using System.Collections;
using System.Collections.Generic;
using System.Drawing;
using System.Globalization;

using Rhino;
using Rhino.Geometry;

using Grasshopper;
using Grasshopper.Kernel;
using Grasshopper.Kernel.Data;
using Grasshopper.Kernel.Types;

public class Script_Instance : GH_ScriptInstance
{
  // ---------------------------------------------------------------
  // PREVIEW FIELDS
  // ---------------------------------------------------------------
  private static readonly Color _defaultColor = Color.Cyan;
  private Brep  _previewVolume = null;
  private Line  _approachLine  = Line.Unset;
  private Color _drawColor     = Color.Cyan;

  public override BoundingBox ClippingBox
  {
    get
    {
      BoundingBox bb = BoundingBox.Empty;
      if (_previewVolume != null) bb.Union(_previewVolume.GetBoundingBox(true));
      if (_approachLine.IsValid) { bb.Union(_approachLine.From); bb.Union(_approachLine.To); }
      return bb;
    }
  }

  public override void DrawViewportMeshes(IGH_PreviewArgs args)
  {
    if (_previewVolume != null)
    {
      Rhino.Display.DisplayMaterial mat = new Rhino.Display.DisplayMaterial(_drawColor);
      mat.Transparency = 0.55;
      args.Display.DrawBrepShaded(_previewVolume, mat);
    }
  }

  public override void DrawViewportWires(IGH_PreviewArgs args)
  {
    if (_previewVolume != null)
      args.Display.DrawBrepWires(_previewVolume, _drawColor, 1);
    if (_approachLine.IsValid)
      args.Display.DrawPatternedLine(
        _approachLine.From, _approachLine.To,
        Color.FromArgb(140, 140, 140), unchecked((int)0xF0F0F0F0), 1);
  }

  private void RunScript(
		Point3d center,
		double radius,
		double depth,
		double stepdown,
		int toolNr,
		Color colour,
		ref object operationLines)
  {
    // Hardcoded tool params -- handled at machine level
    string toolType   = "WZF";
    double feedFactor = 1.0;

    // PREVIEW: clear fields first (before guards) so disconnecting inputs wipes stale geometry
    _previewVolume = null;
    _approachLine  = Line.Unset;
    _drawColor     = colour.IsEmpty ? _defaultColor : colour;

    // ---------------------------------------------------------------
    // 1. DEFAULTS
    // ---------------------------------------------------------------
    operationLines = new List<string>();

    // ---------------------------------------------------------------
    // 2. GUARDS
    // ---------------------------------------------------------------
    if (toolNr <= 0)
    {
      this.Component.AddRuntimeMessage(
        GH_RuntimeMessageLevel.Error, "toolNr is required and must be > 0");
      return;
    }

    if (radius <= 0)
    {
      this.Component.AddRuntimeMessage(
        GH_RuntimeMessageLevel.Error, "radius must be > 0");
      return;
    }

    // ---------------------------------------------------------------
    // 3. INPUT DEFAULTS
    // ---------------------------------------------------------------
    if (depth <= 0) depth = 1.0;

    // PREVIEW: cylinder from center surface downward by depth
    Plane cylPlane = new Plane(center, Vector3d.ZAxis);
    Circle cylCircle = new Circle(cylPlane, radius);
    Cylinder cyl = new Cylinder(cylCircle, -Math.Abs(depth));
    Brep cylBrep = cyl.ToBrep(true, true);
    if (cylBrep != null)
      _previewVolume = cylBrep;

    // PREVIEW: approach line from safeZ to circle center
    double safeZ = center.Z + 20.0;
    _approachLine = new Line(new Point3d(center.X, center.Y, safeZ), center);

    // ---------------------------------------------------------------
    // 4. BUILD TOOL CALL + MACRO
    // ---------------------------------------------------------------
    List<string> lines = new List<string>();
    lines.Add(toolType + " (" + toolNr.ToString()
      + ",_VE,_V*" + feedFactor.ToString(CultureInfo.InvariantCulture)
      + ",_VA,_SD,0,'')");

    double negDepth   = -Math.Abs(depth);
    double zustellung = (stepdown > 0) ? stepdown : 0;

    lines.Add("CALL _Kreistasche_V5(VAL "
      + "X_Mitte:=" + center.X.ToString(CultureInfo.InvariantCulture) + ","
      + "Y_Mitte:=" + center.Y.ToString(CultureInfo.InvariantCulture) + ","
      + "Radius:=" + radius.ToString(CultureInfo.InvariantCulture) + ","
      + "Tiefe:=" + negDepth.ToString(CultureInfo.InvariantCulture) + ","
      + "Zustellung:=" + zustellung.ToString(CultureInfo.InvariantCulture) + ","
      + "AB:=2,ABF:=_ANF,Interpol:=0,umkehren:=0,esxy:=0,esmd:=0,laser:=0)");

    // ---------------------------------------------------------------
    // 5. OUTPUT
    // ---------------------------------------------------------------
    this.Component.AddRuntimeMessage(
      GH_RuntimeMessageLevel.Remark,
      "CircPocket: R=" + radius.ToString(CultureInfo.InvariantCulture)
      + " at (" + center.X.ToString(CultureInfo.InvariantCulture)
      + ", " + center.Y.ToString(CultureInfo.InvariantCulture) + ")");

    operationLines = lines;
  }
}
# ---------- end c_script_4 ----------

# ----
# Vertical drilling
c_script_5 = CSharpScript(
    points=cpoly.Points,
    zSurface=Slider(10, range=0..10),
    depth=Slider(10, range=0..10),
    diameter=Slider(10, range=0..10),
    toolNr=Slider(2, range=0..10))  # -> operationLines; inputs points: list of Point3d, zSurface: Double, depth: Double, diameter: Double, stepdown: Double, toolNr: Int32, colour: Color
# ---------- c_script_5: C# ----------
// HopDrill -- Vertical drilling operation via Bohrung macro
// Inputs: points (List), zSurface (Item), depth (Item), diameter (Item),
//         stepdown (Item), toolNr (Item), colour (Item)
// Outputs: operationLines
//
// Converts a list of Grasshopper points into NC-Hops Bohrung macro strings.
// Each point becomes one Bohrung call with the specified depth and diameter.
// When stepdown > 0, drilling is split into multiple passes at increasing depths.
// Output wires into HopExport.cs operationLines input.
// toolType and feedFactor are hardcoded (WZB / 1.0) -- handled at machine level.

using System;
using System.Collections;
using System.Collections.Generic;
using System.Drawing;
using System.Globalization;

using Rhino;
using Rhino.Geometry;

using Grasshopper;
using Grasshopper.Kernel;
using Grasshopper.Kernel.Data;
using Grasshopper.Kernel.Types;

public class Script_Instance : GH_ScriptInstance
{
  // ---------------------------------------------------------------
  // PREVIEW FIELDS
  // ---------------------------------------------------------------
  private static readonly Color _defaultColor = Color.Red;
  private List<Brep> _previewVolumes   = new List<Brep>();
  private Line       _approachLine     = Line.Unset;
  private Color      _drawColor        = Color.Red;

  public override BoundingBox ClippingBox
  {
    get
    {
      BoundingBox bb = BoundingBox.Empty;
      foreach (Brep b in _previewVolumes) bb.Union(b.GetBoundingBox(true));
      if (_approachLine.IsValid) { bb.Union(_approachLine.From); bb.Union(_approachLine.To); }
      return bb;
    }
  }

  public override void DrawViewportMeshes(IGH_PreviewArgs args)
  {
    if (_previewVolumes.Count > 0)
    {
      Rhino.Display.DisplayMaterial mat = new Rhino.Display.DisplayMaterial(_drawColor);
      mat.Transparency = 0.55;
      foreach (Brep b in _previewVolumes)
        args.Display.DrawBrepShaded(b, mat);
    }
  }

  public override void DrawViewportWires(IGH_PreviewArgs args)
  {
    foreach (Brep b in _previewVolumes)
      args.Display.DrawBrepWires(b, _drawColor, 1);
    if (_approachLine.IsValid)
      args.Display.DrawPatternedLine(
        _approachLine.From, _approachLine.To,
        Color.FromArgb(140, 140, 140), unchecked((int)0xF0F0F0F0), 1);
  }

  private void RunScript(
		List<Point3d> points,
		double zSurface,
		double depth,
		double diameter,
		double stepdown,
		int toolNr,
		Color colour,
		ref object operationLines)
  {
    // Hardcoded tool params -- handled at machine level
    string toolType   = "WZB";
    double feedFactor = 1.0;

    // PREVIEW: clear fields first (before guards) so disconnecting inputs wipes stale geometry
    _previewVolumes.Clear();
    _approachLine = Line.Unset;
    _drawColor    = colour.IsEmpty ? _defaultColor : colour;

    // ---------------------------------------------------------------
    // 1. DEFAULTS -- downstream gets these if guards trigger
    // ---------------------------------------------------------------
    operationLines = new List<string>();

    // ---------------------------------------------------------------
    // 2. GUARDS -- required inputs
    // ---------------------------------------------------------------
    if (points == null || points.Count == 0)
    {
      this.Component.AddRuntimeMessage(
        GH_RuntimeMessageLevel.Error, "No drill points connected");
      return;
    }
    if (toolNr <= 0)
    {
      this.Component.AddRuntimeMessage(
        GH_RuntimeMessageLevel.Error, "toolNr is required and must be > 0");
      return;
    }

    // ---------------------------------------------------------------
    // 3. INPUT DEFAULTS -- fallback for disconnected optional inputs
    // ---------------------------------------------------------------
    if (depth <= 0) depth = 1.0;
    if (diameter <= 0) diameter = 8.0;

    // PREVIEW: cylinder per drill point (after diameter default applied)
    double radius = diameter / 2.0;
    double tol = RhinoDoc.ActiveDoc != null ? RhinoDoc.ActiveDoc.ModelAbsoluteTolerance : 0.01;
    for (int i = 0; i < points.Count; i++)
    {
      Point3d pt = new Point3d(points[i].X, points[i].Y, zSurface);
      Plane cylPlane = new Plane(pt, Vector3d.ZAxis);
      Circle cylCircle = new Circle(cylPlane, radius);
      Cylinder cyl = new Cylinder(cylCircle, -Math.Abs(depth));
      Brep cylBrep = cyl.ToBrep(true, true);
      if (cylBrep != null)
        _previewVolumes.Add(cylBrep);
    }
    // PREVIEW: approach line above first point
    if (points.Count > 0)
    {
      Point3d firstPt = new Point3d(points[0].X, points[0].Y, zSurface);
      double safeZ = zSurface + 20.0;
      _approachLine = new Line(new Point3d(firstPt.X, firstPt.Y, safeZ), firstPt);
    }

    // ---------------------------------------------------------------
    // 4. BUILD TOOL CALL -- first line of output per D-13
    // ---------------------------------------------------------------
    List<string> lines = new List<string>();
    string toolCall = toolType + " (" + toolNr.ToString()
      + ",_VE,_V*" + feedFactor.ToString(CultureInfo.InvariantCulture)
      + ",_VA,_SD,0,'')";
    lines.Add(toolCall);

    // ---------------------------------------------------------------
    // 5. MULTI-PASS OR SINGLE-PASS DRILLING
    // ---------------------------------------------------------------
    if (stepdown > 0)
    {
      // Multi-pass: split depth into incremental passes per D-11
      int passCount = (int)Math.Ceiling(depth / stepdown);
      for (int p = 0; p < passCount; p++)
      {
        double passDepth = Math.Min((p + 1) * stepdown, depth);
        double negPassDepth = -passDepth;
        for (int i = 0; i < points.Count; i++)
        {
          Point3d pt = points[i];
          lines.Add("Bohrung ("
            + pt.X.ToString(CultureInfo.InvariantCulture) + ","
            + pt.Y.ToString(CultureInfo.InvariantCulture) + ","
            + zSurface.ToString(CultureInfo.InvariantCulture) + ","
            + negPassDepth.ToString(CultureInfo.InvariantCulture) + ","
            + diameter.ToString(CultureInfo.InvariantCulture)
            + ",0,0,0,0,0,0,0)");
        }
      }
    }
    else
    {
      // Single pass at full depth per D-08
      double negDepth = -Math.Abs(depth);
      for (int i = 0; i < points.Count; i++)
      {
        Point3d pt = points[i];
        lines.Add("Bohrung ("
          + pt.X.ToString(CultureInfo.InvariantCulture) + ","
          + pt.Y.ToString(CultureInfo.InvariantCulture) + ","
          + zSurface.ToString(CultureInfo.InvariantCulture) + ","
          + negDepth.ToString(CultureInfo.InvariantCulture) + ","
          + diameter.ToString(CultureInfo.InvariantCulture)
          + ",0,0,0,0,0,0,0)");
      }
    }

    // ---------------------------------------------------------------
    // 6. OUTPUT + REMARK
    // ---------------------------------------------------------------
    this.Component.AddRuntimeMessage(
      GH_RuntimeMessageLevel.Remark,
      points.Count.ToString() + " drill points, depth=" + (-Math.Abs(depth)).ToString(CultureInfo.InvariantCulture)
      + ", diameter=" + diameter.ToString(CultureInfo.InvariantCulture));
    operationLines = lines;
  }
}
# ---------- end c_script_5 ----------

brep = Brep(cap)
c_script_6 = CSharpScript(geometry=brep)  # -> dx, dy, dz; inputs geometry: GeometryBase
# ---------- c_script_6: C# ----------
// HopSheet -- Sheet dimension extractor for DYNESTIC CNC
// Inputs:  geometry (Item, GeometryBase)
// Outputs: dx, dy, dz
//
// Accepts a closed curve (flat plate outline) OR a solid Brep (3D part/plate model).
// Extracts dx/dy/dz from the World-XY BoundingBox of the input geometry.
// For a 3D Brep: dz = Z extent (plate thickness derived automatically).
// For a flat curve: dz = 0 (user must set thickness via HopExport directly if needed).
// Outputs wire directly into HopExport dx/dy/dz inputs.
// Shows a grey sheet footprint rectangle in the GH viewport.
//
// GH canvas setup:
//   Input  geometry: Type Hint -> GeometryBase
//   Output dx:       rename to "dx"
//   Output dy:       rename to "dy"
//   Output dz:       rename to "dz"   (matches HopExport input name)
//   Component display name: "HopSheet"

using System;
using System.Collections.Generic;
using System.Drawing;
using System.Globalization;

using Rhino;
using Rhino.Geometry;

using Grasshopper;
using Grasshopper.Kernel;

public class Script_Instance : GH_ScriptInstance
{
  // ---------------------------------------------------------------
  // PREVIEW FIELDS
  // ---------------------------------------------------------------
  private Curve _sheetOutline = null;

  public override BoundingBox ClippingBox
  {
    get { return _sheetOutline != null ? _sheetOutline.GetBoundingBox(true) : BoundingBox.Empty; }
  }

  public override void DrawViewportWires(IGH_PreviewArgs args)
  {
    if (_sheetOutline != null)
      args.Display.DrawCurve(_sheetOutline, Color.FromArgb(180, 180, 180), 2);
  }

  private void RunScript(
		GeometryBase geometry,
		ref object dx,
		ref object dy,
		ref object dz)
  {
    // ---------------------------------------------------------------
    // 1. DEFAULTS
    // ---------------------------------------------------------------
    dx  = 0.0;
    dy  = 0.0;
    dz  = 0.0;
    _sheetOutline = null;

    // ---------------------------------------------------------------
    // 2. NULL GUARD — Warning (not Error) so downstream still computes
    // ---------------------------------------------------------------
    if (geometry == null)
    {
      this.Component.AddRuntimeMessage(GH_RuntimeMessageLevel.Warning,
        "HopSheet: no geometry connected");
      return;
    }

    // ---------------------------------------------------------------
    // 3. BOUNDING BOX EXTRACTION
    //    Curve  -> closed plate outline -> bbox of curve
    //    Brep   -> full solid or surface -> bbox of entire Brep
    //    For a solid Brep, brep.GetBoundingBox(true) is correct and gives all 3 spans.
    //    Do NOT use Faces[0] only -- that gives the bbox of one face, not the whole part.
    // ---------------------------------------------------------------
    BoundingBox bbox = BoundingBox.Empty;

    Curve crv = geometry as Curve;
    if (crv != null)
    {
      if (!crv.IsClosed)
      {
        this.Component.AddRuntimeMessage(GH_RuntimeMessageLevel.Warning,
          "HopSheet: curve must be closed to define a plate outline");
        return;
      }
      bbox = crv.GetBoundingBox(true);
    }
    else
    {
      Brep brep = geometry as Brep;
      if (brep != null && brep.IsValid)
      {
        // Use full-Brep bbox -- correct for both solids and single-face surfaces
        bbox = brep.GetBoundingBox(true);
      }
    }

    if (!bbox.IsValid)
    {
      this.Component.AddRuntimeMessage(GH_RuntimeMessageLevel.Warning,
        "HopSheet: unsupported geometry type -- connect a closed curve or a Brep");
      return;
    }

    // ---------------------------------------------------------------
    // 4. EXTRACT ALL THREE DIMENSIONS FROM BBOX
    // ---------------------------------------------------------------
    double detDx = bbox.Max.X - bbox.Min.X;
    double detDy = bbox.Max.Y - bbox.Min.Y;
    double detDz = bbox.Max.Z - bbox.Min.Z;

    // ---------------------------------------------------------------
    // 5. SMALL-VALUE WARNING -- likely wrong model units
    // ---------------------------------------------------------------
    if (detDx < 10.0 || detDy < 10.0)
      this.Component.AddRuntimeMessage(GH_RuntimeMessageLevel.Warning,
        string.Format(CultureInfo.InvariantCulture,
          "HopSheet: dimensions seem small (dx={0:F1} dy={1:F1}) -- check model units are mm",
          detDx, detDy));

    // ---------------------------------------------------------------
    // 6. REMARK WITH ALL THREE VALUES FOR USER VERIFICATION
    // ---------------------------------------------------------------
    this.Component.AddRuntimeMessage(GH_RuntimeMessageLevel.Remark,
      string.Format(CultureInfo.InvariantCulture,
        "HopSheet: dx={0:F1}mm  dy={1:F1}mm  dz={2:F1}mm",
        detDx, detDy, detDz));

    // ---------------------------------------------------------------
    // 7. VIEWPORT PREVIEW -- grey footprint rectangle at Z=0
    // ---------------------------------------------------------------
    var rect = new Rectangle3d(Plane.WorldXY,
      new Interval(bbox.Min.X, bbox.Max.X),
      new Interval(bbox.Min.Y, bbox.Max.Y));
    _sheetOutline = rect.ToNurbsCurve();

    // ---------------------------------------------------------------
    // 8. OUTPUTS
    // ---------------------------------------------------------------
    dx = detDx;
    dy = detDy;
    dz = detDz;
  }
}
# ---------- end c_script_6 ----------

# ----
# Export
panel = Panel("Test_1m_Platte_mit_Tasche_v.2")
path = FilePath("D:\Projekte\SynologyDrive\53_post-processor\test\")
c_script_7 = CSharpScript(
    folder=path,
    fileName=panel,
    export=Toggle(True),
    dx=c_script_6.dx,
    dy=c_script_6.dy,
    dz=c_script_6.dz,
    operationLines=c_script_2)  # -> hopContent, statusMsg; inputs folder: String, fileName: String, export: Boolean, dx: Double, dy: Double, dz: Double, wzgv: String, operationLines: list of String
# ---------- c_script_7: C# ----------
// HopExport -- Core .hop file generator for DYNESTIC CNC
// Inputs: folder (Item), fileName (Item), export (Item), dx (Item), dy (Item), dz (Item),
//         wzgv (Item), operationLines (List)
// Outputs: hopContent, statusMsg
//
// folder   -- output directory, e.g. D:/Projekte/test/
// fileName -- file name without extension, e.g. Tisch_bohren
//
// Assembles and writes syntactically valid .hop files from GH inputs.
// Follows the kukaprc_toolpath.cs guard-default-work-output pattern.
// Phase 3+ operation components wire their List<string> output into operationLines.

using System;
using System.Collections;
using System.Collections.Generic;
using System.Drawing;
using System.IO;
using System.Text;
using System.Globalization;

using Rhino;
using Rhino.Geometry;

using Grasshopper;
using Grasshopper.Kernel;
using Grasshopper.Kernel.Data;
using Grasshopper.Kernel.Types;

public class Script_Instance : GH_ScriptInstance
{
  private void RunScript(
		string folder,
		string fileName,
		bool export,
		double dx,
		double dy,
		double dz,
		string wzgv,
		List<string> operationLines,
		ref object hopContent,
		ref object statusMsg)
  {
    // ---------------------------------------------------------------
    // 1. DEFAULTS -- downstream gets these if guards trigger
    // ---------------------------------------------------------------
    hopContent = "";
    statusMsg = "";

    // ---------------------------------------------------------------
    // 2. EXPORT GUARD -- silent return when not exporting
    // ---------------------------------------------------------------
    if (!export) return;

    // ---------------------------------------------------------------
    // 3. INPUT DEFAULTS -- fallback for disconnected inputs
    // ---------------------------------------------------------------
    if (dx <= 0) dx = 800.0;
    if (dy <= 0) dy = 400.0;
    if (dz <= 0) dz = 19.0;
    if (wzgv == null) wzgv = "7023K_681";

    // ---------------------------------------------------------------
    // 4. VALIDATION -- error messages for invalid required inputs
    // ---------------------------------------------------------------
    if (string.IsNullOrWhiteSpace(folder))
    {
      this.Component.AddRuntimeMessage(
        GH_RuntimeMessageLevel.Error, "folder is empty");
      return;
    }

    if (string.IsNullOrWhiteSpace(fileName))
    {
      this.Component.AddRuntimeMessage(
        GH_RuntimeMessageLevel.Error, "fileName is empty");
      return;
    }

    string directory = Path.GetFullPath(folder);

    if (!Directory.Exists(directory))
    {
      this.Component.AddRuntimeMessage(
        GH_RuntimeMessageLevel.Error, "Directory does not exist: " + directory);
      return;
    }

    // Strip .hop extension if user typed it, then re-add -- always clean
    string stem = fileName.EndsWith(".hop", StringComparison.OrdinalIgnoreCase)
      ? fileName.Substring(0, fileName.Length - 4)
      : fileName;

    string fullPath = Path.Combine(directory, stem + ".hop");

    if (operationLines == null)
    {
      operationLines = new List<string>();
    }

    // ---------------------------------------------------------------
    // 5. BUILD HEADER -- match Muster_DXF_Import.hop order exactly
    // ---------------------------------------------------------------
    string ncName = stem;

    List<string> lines = new List<string>();
    lines.Add(";MAKROTYP=0");
    lines.Add(";INSTVERSION=");
    lines.Add(";EXEVERSION=");
    lines.Add(";BILD=");
    lines.Add(";INFO=");

    // WZGV is conditional -- omit line entirely if empty string
    if (!string.IsNullOrEmpty(wzgv))
    {
      lines.Add(";WZGV=" + wzgv);
    }

    lines.Add(";WZGVCONFIG=");
    lines.Add(";MASCHINE=HOLZHER");
    lines.Add(";NCNAME=" + ncName);
    lines.Add(";KOMMENTAR=");
    lines.Add(";DX=0.000");
    lines.Add(";DY=0.000");
    lines.Add(";DZ=0");
    lines.Add(";DIALOGDLL=Dialoge.Dll");
    lines.Add(";DIALOGPROC=StandardFormAnzeigen");
    lines.Add(";AUTOSCRIPTSTART=1");
    lines.Add(";BUTTONBILD=");
    lines.Add(";DIMENSION_UNIT=0");

    // ---------------------------------------------------------------
    // 6. BUILD VARS BLOCK -- 3-space indent, InvariantCulture decimals
    // ---------------------------------------------------------------
    lines.Add("VARS");
    lines.Add("   DX := " + dx.ToString(CultureInfo.InvariantCulture) + ";*VAR*Dimension X");
    lines.Add("   DY := " + dy.ToString(CultureInfo.InvariantCulture) + ";*VAR*Dimension Y");
    lines.Add("   DZ := " + dz.ToString(CultureInfo.InvariantCulture) + ";*VAR*Dimension Z");

    // ---------------------------------------------------------------
    // 7. BUILD START SECTION -- Fertigteil + HH_Park
    // ---------------------------------------------------------------
    lines.Add("START");
    lines.Add("Fertigteil (DX,DY,DZ,0,0,0,0,0,'',0,0,0)");
    lines.Add("CALL HH_Park ( VAL PARK:=3,X:=0,Y:=0)");

    // ---------------------------------------------------------------
    // 8. INSERT OPERATION LINES -- Phase 3+ integration point
    // ---------------------------------------------------------------
    for (int i = 0; i < operationLines.Count; i++)
    {
      lines.Add(operationLines[i]);
    }

    // ---------------------------------------------------------------
    // 9. ASSEMBLE AND WRITE -- CRLF line endings, ASCII encoding
    // ---------------------------------------------------------------
    string content = string.Join("\r\n", lines) + "\r\n";
    File.WriteAllText(fullPath, content, Encoding.ASCII);

    // ---------------------------------------------------------------
    // 10. SUCCESS OUTPUT
    // ---------------------------------------------------------------
    this.Component.AddRuntimeMessage(
      GH_RuntimeMessageLevel.Remark, "Exported: " + fullPath);
    hopContent = content;
    statusMsg = "Exported: " + fullPath;
  }
}
# ---------- end c_script_7 ----------
panel_2 = Panel(c_script_7.hopContent)
panel_3 = Panel(c_script_7.statusMsg)

entwine = Entwine(Branch00=c_script_2, Branch01=c_script_5, Branch02=c_script_4, FlattenInputs=True)
c_script_8 = CSharpScript(outline=rectangle_2.Rectangle, operationLines=entwine, grainAngle=number_slider_2)  # -> flatten(part); inputs outline: Curve, operationLines: list of String, grainAngle: Double, colour: Color
# ---------- c_script_8: C# ----------
// HopPart -- Part bundling component for DYNESTIC CNC nesting workflow
// Inputs:  outline (Item, Curve), operationLines (List, string), grainAngle (Item, double)
// Outputs: part (single output)
//
// Bundles a closed part outline + all operation lines into a Dictionary<string,object>
// wrapped in GH_ObjectWrapper for cross-component transport.
// The outline curve is used by OpenNest as the nesting boundary.
// operationLines from multiple op-components are flattened into the dictionary.
// grainAngle rotates the grain direction arrow (0 = X-axis, 90 = Y-axis).
// Per D-04, D-05, D-07: HopPart is the unit OpenNest receives.
//
// GH canvas setup:
//   Input  outline:        Type Hint -> Curve
//   Input  operationLines: Type Hint -> string,  List Access
//   Input  grainAngle:     Type Hint -> double
//   Input  colour:         Type Hint -> System.Drawing.Color
//   Output part:           rename to "part"
//   Component display name: "HopPart"

using System;
using System.Collections.Generic;
using System.Drawing;
using System.Globalization;

using Rhino;
using Rhino.Geometry;

using Grasshopper;
using Grasshopper.Kernel;
using Grasshopper.Kernel.Types;

public class Script_Instance : GH_ScriptInstance
{
  // ---------------------------------------------------------------
  // PREVIEW FIELDS
  // ---------------------------------------------------------------
  private static readonly Color _defaultColor = Color.FromArgb(100, 149, 237);
  private Curve   _outlineCurve = null;
  private Line    _grainArrow   = Line.Unset;
  private Color   _drawColor    = Color.FromArgb(100, 149, 237);

  public override BoundingBox ClippingBox
  {
    get
    {
      BoundingBox bb = BoundingBox.Empty;
      if (_outlineCurve != null) bb.Union(_outlineCurve.GetBoundingBox(true));
      if (_grainArrow.IsValid) { bb.Union(_grainArrow.From); bb.Union(_grainArrow.To); }
      return bb;
    }
  }

  public override void DrawViewportWires(IGH_PreviewArgs args)
  {
    if (_outlineCurve != null)
      args.Display.DrawCurve(_outlineCurve, _drawColor, 2);

    if (_grainArrow.IsValid)
    {
      args.Display.DrawArrow(
        _grainArrow,
        Color.FromArgb(80, 80, 80), 0.0, 3.0);
    }
  }

  public override void DrawViewportMeshes(IGH_PreviewArgs args)
  {
    // Required override -- no mesh preview for HopPart
  }

  private void RunScript(
		Curve outline,
		List<string> operationLines,
		double grainAngle,
		Color colour,
		ref object part)
  {
    // ---------------------------------------------------------------
    // 1. DEFAULTS -- clear preview fields before guards
    // ---------------------------------------------------------------
    _outlineCurve = null;
    _grainArrow   = Line.Unset;
    _drawColor    = colour.IsEmpty ? _defaultColor : colour;
    part = null;

    // ---------------------------------------------------------------
    // 2. GUARDS
    // ---------------------------------------------------------------
    if (outline == null)
    {
      this.Component.AddRuntimeMessage(GH_RuntimeMessageLevel.Error,
        "HopPart: no outline curve connected");
      return;
    }
    if (!outline.IsClosed)
    {
      this.Component.AddRuntimeMessage(GH_RuntimeMessageLevel.Error,
        "HopPart: outline curve must be closed");
      return;
    }

    // ---------------------------------------------------------------
    // 3. INPUT DEFAULTS
    // ---------------------------------------------------------------
    if (operationLines == null) operationLines = new List<string>();
    if (grainAngle < 0 || grainAngle > 360) grainAngle = 0;

    // ---------------------------------------------------------------
    // 4. GRAIN DIRECTION VECTOR
    // ---------------------------------------------------------------
    double rad = grainAngle * Math.PI / 180.0;
    Vector3d grainDir = new Vector3d(Math.Cos(rad), Math.Sin(rad), 0);

    // ---------------------------------------------------------------
    // 5. BUILD DICTIONARY (per D-04, D-07 -- wire format)
    //    operationLines stored as List<List<string>> for grouping
    //    compatibility with downstream HopSheetExport.
    // ---------------------------------------------------------------
    var opLineGroups = new List<List<string>>();
    opLineGroups.Add(new List<string>(operationLines));

    var dict = new Dictionary<string, object>();
    dict["outline"]        = outline;
    dict["operationLines"] = opLineGroups;
    dict["grainDir"]       = grainDir;

    // ---------------------------------------------------------------
    // 6. PREVIEW -- outline curve + grain arrow (per D-12)
    // ---------------------------------------------------------------
    _outlineCurve = outline;

    // Grain arrow: 20mm arrow from centroid along grain direction
    var amp = AreaMassProperties.Compute(outline);
    if (amp != null)
    {
      Point3d centroid = amp.Centroid;
      double arrowLen = 20.0;
      Point3d arrowEnd = centroid + grainDir * arrowLen;
      _grainArrow = new Line(centroid, arrowEnd);
    }

    // ---------------------------------------------------------------
    // 7. OUTPUT -- wrap in GH_ObjectWrapper for cross-assembly transport
    // ---------------------------------------------------------------
    part = new Grasshopper.Kernel.Types.GH_ObjectWrapper(dict);

    this.Component.AddRuntimeMessage(GH_RuntimeMessageLevel.Remark,
      "HopPart: " + operationLines.Count + " operation lines bundled"
      + ", grain=" + grainAngle.ToString(CultureInfo.InvariantCulture) + " deg");
  }
}
# ---------- end c_script_8 ----------

division = Division(A=Slider(1000, range=0..1000), B=2)
pt = Point(Point(0, 0, 0))
X_2 = UnitX(Factor=division)
Y_2 = UnitY(Factor=division)

move_3 = Move(Geometry=pt, Motion=X_2)  # -> Geometry, Transform

move_4 = Move(Geometry=move_3.Geometry, Motion=Y_2)  # -> Geometry, Transform

# ----
# Free slot operation
c_script_9 = CSharpScript(
    p1=move_3.Geometry,
    p2=move_4.Geometry,
    slotWidth=Slider(53, range=0..100),
    depth=Slider(10, range=0..10),
    toolNr=Slider(1, range=0..100))  # -> operationLines; inputs p1: Point3d, p2: Point3d, slotWidth: Double, depth: Double, toolNr: Int32, colour: Color
# ---------- c_script_9: C# ----------
// HopFreeSlot -- Free slot operation for DYNESTIC CNC
// Inputs: p1 (Item), p2 (Item), slotWidth (Item),
//         depth (Item), toolNr (Item), colour (Item)
// Outputs: operationLines
//
// Takes two Point3d inputs (slot start and end) plus slot width.
// Emits WZF tool call + CALL _nuten_frei_v5 macro for HopExport.
// toolType and feedFactor are hardcoded (WZF / 1.0) -- handled at machine level.

using System;
using System.Collections;
using System.Collections.Generic;
using System.Drawing;
using System.Globalization;

using Rhino;
using Rhino.Geometry;

using Grasshopper;
using Grasshopper.Kernel;
using Grasshopper.Kernel.Data;
using Grasshopper.Kernel.Types;

public class Script_Instance : GH_ScriptInstance
{
  // ---------------------------------------------------------------
  // PREVIEW FIELDS
  // ---------------------------------------------------------------
  private static readonly Color _defaultColor = Color.Orange;
  private Brep  _previewVolume = null;
  private Line  _approachLine  = Line.Unset;
  private Color _drawColor     = Color.Orange;

  public override BoundingBox ClippingBox
  {
    get
    {
      BoundingBox bb = BoundingBox.Empty;
      if (_previewVolume != null) bb.Union(_previewVolume.GetBoundingBox(true));
      if (_approachLine.IsValid) { bb.Union(_approachLine.From); bb.Union(_approachLine.To); }
      return bb;
    }
  }

  public override void DrawViewportMeshes(IGH_PreviewArgs args)
  {
    if (_previewVolume != null)
    {
      Rhino.Display.DisplayMaterial mat = new Rhino.Display.DisplayMaterial(_drawColor);
      mat.Transparency = 0.55;
      args.Display.DrawBrepShaded(_previewVolume, mat);
    }
  }

  public override void DrawViewportWires(IGH_PreviewArgs args)
  {
    if (_previewVolume != null)
      args.Display.DrawBrepWires(_previewVolume, _drawColor, 1);
    if (_approachLine.IsValid)
      args.Display.DrawPatternedLine(
        _approachLine.From, _approachLine.To,
        Color.FromArgb(140, 140, 140), unchecked((int)0xF0F0F0F0), 1);
  }

  private void RunScript(
		Point3d p1,
		Point3d p2,
		double slotWidth,
		double depth,
		int toolNr,
		Color colour,
		ref object operationLines)
  {
    // Hardcoded tool params -- handled at machine level
    string toolType   = "WZF";
    double feedFactor = 1.0;

    // PREVIEW: clear fields first (before guards) so disconnecting inputs wipes stale geometry
    _previewVolume = null;
    _approachLine  = Line.Unset;
    _drawColor     = colour.IsEmpty ? _defaultColor : colour;

    // ---------------------------------------------------------------
    // 1. DEFAULTS
    // ---------------------------------------------------------------
    operationLines = new List<string>();

    // ---------------------------------------------------------------
    // 2. GUARDS
    // ---------------------------------------------------------------
    if (toolNr <= 0)
    {
      this.Component.AddRuntimeMessage(
        GH_RuntimeMessageLevel.Error, "toolNr is required and must be > 0");
      return;
    }

    if (slotWidth <= 0)
    {
      this.Component.AddRuntimeMessage(
        GH_RuntimeMessageLevel.Error, "slotWidth must be > 0");
      return;
    }

    // ---------------------------------------------------------------
    // 3. INPUT DEFAULTS
    // ---------------------------------------------------------------
    if (depth <= 0) depth = 1.0;

    // PREVIEW: box along slot centerline at surface level, extruded downward by depth
    double tol = RhinoDoc.ActiveDoc != null ? RhinoDoc.ActiveDoc.ModelAbsoluteTolerance : 0.01;
    double topZ = Math.Max(p1.Z, p2.Z);
    Point3d a = new Point3d(p1.X, p1.Y, topZ);
    Point3d b = new Point3d(p2.X, p2.Y, topZ);

    Vector3d dir = b - a;
    if (dir.Length > 0.001)
    {
      dir.Unitize();
      // Perpendicular in XY
      Vector3d perp = Vector3d.CrossProduct(dir, Vector3d.ZAxis);
      perp.Unitize();
      double halfW = slotWidth / 2.0;

      // Four corner points of slot rectangle at topZ
      Point3d c0 = a + perp * halfW;
      Point3d c1 = b + perp * halfW;
      Point3d c2 = b - perp * halfW;
      Point3d c3 = a - perp * halfW;

      // Build closed polyline as slot base
      Polyline slotPoly = new Polyline(new Point3d[] { c0, c1, c2, c3, c0 });
      Curve slotCurve = slotPoly.ToNurbsCurve();

      if (slotCurve != null && slotCurve.IsClosed)
      {
        Vector3d extDir = new Vector3d(0, 0, -Math.Abs(depth));
        Surface extSrf = Surface.CreateExtrusion(slotCurve, extDir);
        if (extSrf != null)
        {
          Brep extBrep = extSrf.ToBrep();
          if (extBrep != null)
          {
            Brep capped = extBrep.CapPlanarHoles(tol);
            _previewVolume = capped != null ? capped : extBrep;
          }
        }
      }
    }

    // PREVIEW: approach line from safeZ to p1
    double safeZVal = Math.Max(p1.Z, p2.Z) + 20.0;
    _approachLine = new Line(new Point3d(a.X, a.Y, safeZVal), a);

    // ---------------------------------------------------------------
    // 4. BUILD TOOL CALL + MACRO
    // ---------------------------------------------------------------
    List<string> lines = new List<string>();
    lines.Add(toolType + " (" + toolNr.ToString()
      + ",_VE,_V*" + feedFactor.ToString(CultureInfo.InvariantCulture)
      + ",_VA,_SD,0,'')");

    double negDepth = -Math.Abs(depth);

    lines.Add("CALL _nuten_frei_v5(VAL "
      + "X1:=" + p1.X.ToString(CultureInfo.InvariantCulture) + ","
      + "Y1:=" + p1.Y.ToString(CultureInfo.InvariantCulture) + ","
      + "X2:=" + p2.X.ToString(CultureInfo.InvariantCulture) + ","
      + "Y2:=" + p2.Y.ToString(CultureInfo.InvariantCulture) + ","
      + "NB:=" + slotWidth.ToString(CultureInfo.InvariantCulture) + ","
      + "Tiefe:=" + negDepth.ToString(CultureInfo.InvariantCulture) + ","
      + "LAGE:=0,RK:=0,SPEGA:=0,EPEGA:=0,esmd:=0,esxy1:=0,esxy2:=0)");

    // ---------------------------------------------------------------
    // 5. OUTPUT
    // ---------------------------------------------------------------
    this.Component.AddRuntimeMessage(
      GH_RuntimeMessageLevel.Remark,
      "FreeSlot: (" + p1.X.ToString(CultureInfo.InvariantCulture)
      + "," + p1.Y.ToString(CultureInfo.InvariantCulture)
      + ") to (" + p2.X.ToString(CultureInfo.InvariantCulture)
      + "," + p2.Y.ToString(CultureInfo.InvariantCulture)
      + ") W=" + slotWidth.ToString(CultureInfo.InvariantCulture));

    operationLines = lines;
  }
}
# ---------- end c_script_9 ----------

entwine_2 = Entwine(
    Branch00=c_script_2,
    Branch01=c_script_5,
    Branch02=c_script_4,
    Branch03=c_script_3,
    Branch04=c_script,
    Branch05=c_script_9,
    FlattenInputs=True)
c_script_10 = CSharpScript(outline=rectangle_2.Rectangle, operationLines=entwine_2, grainAngle=number_slider_2)  # -> flatten(part); inputs outline: Curve, operationLines: list of String, grainAngle: Double, colour: Color; same code as c_script_8
entwine_3 = Entwine(Branch00=c_script_10, Branch01=c_script_8, FlattenInputs=True)
c_script_11 = CSharpScript(parts=entwine_3)  # -> hopContent, statusMsg; inputs parts: list, ids: list of Int32, sheetCurve: Curve, sheetIndex: Int32, folder: String, fileName: String, wzgv: String, dz: Double, export: Boolean
# ---------- c_script_11: C# ----------
// HopSheetExport -- Per-sheet .hop file export for nested DYNESTIC CNC workflow
// Inputs:  parts (List, object), ids (List, int), sheetCurve (Item, Curve),
//          sheetIndex (Item, int), folder (Item, string), fileName (Item, string),
//          wzgv (Item, string), dz (Item, double), export (Item, bool)
// Outputs: hopContent, statusMsg
//
// Receives HopPart dictionaries + OpenNest IDS output.
// Filters parts where ids[i] == sheetIndex.
// Extracts dx/dy from sheetCurve BoundingBox (same pattern as HopSheet.cs).
// Assembles .hop file identical to HopExport structure.
// Per D-08, D-09, D-10: one HopSheetExport per sheet, manual trigger, user names files.
//
// GH canvas setup:
//   Input  parts:      Type Hint -> NO TYPE HINT,  List Access
//   Input  ids:        Type Hint -> int,            List Access
//   Input  sheetCurve: Type Hint -> Curve
//   Input  sheetIndex: Type Hint -> int
//   Input  folder:     Type Hint -> string
//   Input  fileName:   Type Hint -> string
//   Input  wzgv:       Type Hint -> string
//   Input  dz:         Type Hint -> double
//   Input  export:     Type Hint -> bool
//   Output hopContent: rename to "hopContent"
//   Output statusMsg:  rename to "statusMsg"
//   Component display name: "HopSheetExport"

using System;
using System.Collections.Generic;
using System.Drawing;
using System.IO;
using System.Text;
using System.Globalization;

using Rhino;
using Rhino.Geometry;

using Grasshopper;
using Grasshopper.Kernel;
using Grasshopper.Kernel.Types;

public class Script_Instance : GH_ScriptInstance
{
  private void RunScript(
		List<object> parts,
		List<int> ids,
		Curve sheetCurve,
		int sheetIndex,
		string folder,
		string fileName,
		string wzgv,
		double dz,
		bool export,
		ref object hopContent,
		ref object statusMsg)
  {
    // ---------------------------------------------------------------
    // 1. DEFAULTS -- downstream gets these if guards trigger
    // ---------------------------------------------------------------
    hopContent = "";
    statusMsg = "";

    // ---------------------------------------------------------------
    // 2. EXPORT GUARD -- silent return when not exporting
    // ---------------------------------------------------------------
    if (!export) return;

    // ---------------------------------------------------------------
    // 3. INPUT DEFAULTS -- fallback for disconnected inputs
    // ---------------------------------------------------------------
    if (wzgv == null) wzgv = "7023K_681";
    if (dz <= 0) dz = 19.0;

    // ---------------------------------------------------------------
    // 4. VALIDATION -- error messages for invalid required inputs
    // ---------------------------------------------------------------
    if (string.IsNullOrWhiteSpace(folder))
    {
      this.Component.AddRuntimeMessage(
        GH_RuntimeMessageLevel.Error, "HopSheetExport: folder is empty");
      return;
    }

    if (string.IsNullOrWhiteSpace(fileName))
    {
      this.Component.AddRuntimeMessage(
        GH_RuntimeMessageLevel.Error, "HopSheetExport: fileName is empty");
      return;
    }

    string directory = Path.GetFullPath(folder);

    if (!Directory.Exists(directory))
    {
      this.Component.AddRuntimeMessage(
        GH_RuntimeMessageLevel.Error,
        "HopSheetExport: directory does not exist: " + directory);
      return;
    }

    // Strip .hop extension if user typed it, then re-add -- always clean
    string stem = fileName.EndsWith(".hop", StringComparison.OrdinalIgnoreCase)
      ? fileName.Substring(0, fileName.Length - 4)
      : fileName;

    string fullPath = Path.Combine(directory, stem + ".hop");

    if (parts == null || parts.Count == 0)
    {
      this.Component.AddRuntimeMessage(
        GH_RuntimeMessageLevel.Error,
        "HopSheetExport: no parts connected");
      return;
    }

    if (ids == null || ids.Count == 0)
    {
      this.Component.AddRuntimeMessage(
        GH_RuntimeMessageLevel.Error,
        "HopSheetExport: no IDS connected (connect OpenNest IDS output)");
      return;
    }

    if (parts.Count != ids.Count)
    {
      this.Component.AddRuntimeMessage(
        GH_RuntimeMessageLevel.Error,
        "HopSheetExport: parts count (" + parts.Count
        + ") != ids count (" + ids.Count + ") -- lists must match");
      return;
    }

    if (sheetCurve == null)
    {
      this.Component.AddRuntimeMessage(
        GH_RuntimeMessageLevel.Error,
        "HopSheetExport: no sheet curve connected");
      return;
    }

    if (sheetIndex < 0)
    {
      this.Component.AddRuntimeMessage(
        GH_RuntimeMessageLevel.Error,
        "HopSheetExport: sheetIndex must be >= 0");
      return;
    }

    // ---------------------------------------------------------------
    // 5. SHEET DIMENSIONS -- BoundingBox pattern from HopSheet.cs
    // ---------------------------------------------------------------
    BoundingBox sheetBB = sheetCurve.GetBoundingBox(true);
    double sheetDx = sheetBB.Max.X - sheetBB.Min.X;
    double sheetDy = sheetBB.Max.Y - sheetBB.Min.Y;
    // dz comes from input parameter (cannot derive from 2D sheet curve)

    // ---------------------------------------------------------------
    // 6. FILTER PARTS BY SHEET INDEX -- OpenNest IDS semantics
    // ---------------------------------------------------------------
    List<string> allOpLines = new List<string>();
    int partsOnSheet = 0;
    int unfittedCount = 0;

    for (int i = 0; i < ids.Count; i++)
    {
      if (ids[i] == -1)
      {
        unfittedCount++;
        continue;
      }
      if (ids[i] != sheetIndex) continue;

      // Unwrap HopPart dictionary
      var wrapper = parts[i] as Grasshopper.Kernel.Types.GH_ObjectWrapper;
      if (wrapper == null) continue;
      var dict = wrapper.Value as Dictionary<string, object>;
      if (dict == null) continue;

      var opLineGroups = dict["operationLines"] as List<List<string>>;
      if (opLineGroups != null)
      {
        foreach (var group in opLineGroups)
        {
          foreach (string line in group)
          {
            allOpLines.Add(line);
          }
        }
      }
      partsOnSheet++;
    }

    if (unfittedCount > 0)
    {
      this.Component.AddRuntimeMessage(
        GH_RuntimeMessageLevel.Warning,
        unfittedCount + " part(s) did not fit on any sheet (IDS=-1)");
    }

    if (partsOnSheet == 0)
    {
      this.Component.AddRuntimeMessage(
        GH_RuntimeMessageLevel.Warning,
        "HopSheetExport: no parts assigned to sheet " + sheetIndex);
      return;
    }

    // ---------------------------------------------------------------
    // 7. BUILD HEADER -- match HopExport.cs / Muster_DXF_Import.hop
    //    order exactly
    // ---------------------------------------------------------------
    string ncName = stem;

    List<string> lines = new List<string>();
    lines.Add(";MAKROTYP=0");
    lines.Add(";INSTVERSION=");
    lines.Add(";EXEVERSION=");
    lines.Add(";BILD=");
    lines.Add(";INFO=");

    // WZGV is conditional -- omit line entirely if empty string
    if (!string.IsNullOrEmpty(wzgv))
    {
      lines.Add(";WZGV=" + wzgv);
    }

    lines.Add(";WZGVCONFIG=");
    lines.Add(";MASCHINE=HOLZHER");
    lines.Add(";NCNAME=" + ncName);
    lines.Add(";KOMMENTAR=");
    lines.Add(";DX=0.000");
    lines.Add(";DY=0.000");
    lines.Add(";DZ=0");
    lines.Add(";DIALOGDLL=Dialoge.Dll");
    lines.Add(";DIALOGPROC=StandardFormAnzeigen");
    lines.Add(";AUTOSCRIPTSTART=1");
    lines.Add(";BUTTONBILD=");
    lines.Add(";DIMENSION_UNIT=0");

    // ---------------------------------------------------------------
    // 8. BUILD VARS BLOCK -- 3-space indent, InvariantCulture decimals
    // ---------------------------------------------------------------
    lines.Add("VARS");
    lines.Add("   DX := " + sheetDx.ToString(CultureInfo.InvariantCulture) + ";*VAR*Dimension X");
    lines.Add("   DY := " + sheetDy.ToString(CultureInfo.InvariantCulture) + ";*VAR*Dimension Y");
    lines.Add("   DZ := " + dz.ToString(CultureInfo.InvariantCulture) + ";*VAR*Dimension Z");

    // ---------------------------------------------------------------
    // 9. BUILD START SECTION -- Fertigteil + HH_Park
    // ---------------------------------------------------------------
    lines.Add("START");
    lines.Add("Fertigteil (DX,DY,DZ,0,0,0,0,0,'',0,0,0)");
    lines.Add("CALL HH_Park ( VAL PARK:=3,X:=0,Y:=0)");

    // ---------------------------------------------------------------
    // 10. INSERT OPERATION LINES -- all parts on this sheet
    // ---------------------------------------------------------------
    for (int i = 0; i < allOpLines.Count; i++)
    {
      lines.Add(allOpLines[i]);
    }

    // ---------------------------------------------------------------
    // 11. ASSEMBLE AND WRITE -- CRLF line endings, ASCII encoding
    // ---------------------------------------------------------------
    string content = string.Join("\r\n", lines) + "\r\n";
    File.WriteAllText(fullPath, content, Encoding.ASCII);

    // ---------------------------------------------------------------
    // 12. SUCCESS OUTPUT
    // ---------------------------------------------------------------
    this.Component.AddRuntimeMessage(
      GH_RuntimeMessageLevel.Remark,
      "HopSheetExport: exported sheet " + sheetIndex
      + " (" + partsOnSheet + " parts, " + allOpLines.Count + " op lines) -> " + fullPath);
    hopContent = content;
    statusMsg = "Exported sheet " + sheetIndex + ": " + fullPath;
  }
}
# ---------- end c_script_11 ----------
