# Grasshopper definition bench.gh (Grasshopper 1.0.8)
# plug-ins: Wallaby Hop

rectc1 = CircleCNR(Center=Point(180, 180, 19), Normal=Vector(0, 0, 1), Radius=30)
rectc2 = CircleCNR(Center=Point(180, 290, 19), Normal=Vector(0, 0, 1), Radius=25)
contourc1 = CircleCNR(Center=Point(650, 120, 19), Normal=Vector(0, 0, 1), Radius=50)
contourc2 = CircleCNR(Center=Point(650, 300, 19), Normal=Vector(0, 0, 1), Radius=40)
engravec = CircleCNR(Center=Point(550, 480, 19), Normal=Vector(0, 0, 1), Radius=30)
sawl1 = Line(StartPoint=Point(520, 200, 19), EndPoint=Point(780, 200, 19))
sawl2 = Line(StartPoint=Point(520, 240, 19), EndPoint=Point(780, 240, 19))
list = ValueList({"X-cut (fixed Y)": 0, "Y-cut (fixed X)": 1}, selected="X-cut (fixed Y)")
list_2 = ValueList({"Front edge": 0, "Back edge": 1}, selected="Front edge")
list_3 = ValueList({"X-groove": 0, "Y-groove": 1}, selected="X-groove")
list_4 = ValueList({"Ebene 0": 0, "Ebene 1": 1}, selected="Ebene 0")
list_5 = ValueList({"Inside": 1, "Center": 0, "Outside": -1}, selected="Inside")
list_6 = ValueList({"Left": 1, "Center": 0, "Right": -1}, selected="Left")
list_7 = ValueList({"Left": 1, "Center": 0, "Right": -1}, selected="Left")
list_8 = ValueList({"X-row": 0, "Y-row": 1}, selected="X-row")
crv = Curve()
pt = Point([Point(22.5, 150, 19), Point(22.5, 250, 19)])
crv_2 = Curve()
pt_2 = Point([Point(400, 330, 19), Point(400, 360, 19)])
crv_3 = Curve()
pt_3 = Point([Point(300, 220, 19), Point(430, 220, 19)])
pt_4 = Point([Point(60, 60, 19), Point(120, 60, 19), Point(180, 60, 19)])
pt_5 = Point([Point(300, 80, 19), Point(360, 80, 19), Point(420, 80, 19)])
pt_6 = Point([Point(60, 540, 19), Point(60, 480, 19)])
pt_7 = Point([Point(250, 400, 19), Point(250, 450, 19)])
pt_8 = Point([Point(450, 400, 19), Point(450, 450, 19)])
pt_9 = Point([Point(550, 560, 9.5), Point(750, 300, 9.5), Point(700, 40, 9.5)])
crv_4 = Curve()
pt_10 = Point([Point(0, 590, 19), Point(0, 10, 19)])
hopblumhinge = HopBlumHinge(
    Positions=pt,
    Distance=Slider(22.5, range=1..100),
    Side=list_2,
    CupDiameter=Slider(35, range=10..50),
    CupDepth=Slider(12.8, range=1..30),
    DowelDiameter=Slider(8, range=0..20),
    DowelDepth=Slider(13, range=0..30),
    ToolNr=Slider(1, range=1..20),
    Colour=RGB(147, 112, 219))
hopcontour = HopContour(
    Curve=[crv_2, contourc1, contourc2],
    Depth=Slider(10, range=1..100),
    LeadIn=Slider(0, range=0..100),
    Tolerance=Slider(0.1, range=0.001..1),
    ToolNr=Slider(1, range=1..20),
    ToolDiameter=Slider(8, range=1..50),
    Side=list_6,
    Passes=Slider(0, range=0..50),
    Overcut=0,
    LeadOut=0,
    AutoFlip=False,
    CornerStyle=0,
    Colour=RGB(255, 255, 0))
hoprectpocket = HopRectPocket(
    RectCurve=[crv, rectc1, rectc2],
    CornerRadius=Slider(0, range=0..50),
    Angle=Slider(0, range=0..360),
    Depth=Slider(10, range=1..100),
    Stepdown=Slider(0, range=0..50),
    ToolNr=Slider(1, range=1..20),
    Colour=RGB(0, 255, 255))
hopgrooveslot = HopGrooveSlot(
    Direction=list_3,
    Position=pt_2,
    Width=Slider(8, range=1..50),
    Depth=Slider(8, range=1..50),
    Ebene=list_4,
    ShortenStart=Slider(0, range=0..100),
    ShortenEnd=Slider(0, range=0..100),
    ToolNr=Slider(1, range=1..20),
    Colour=RGB(255, 165, 0))
hopsaw = HopSaw(
    DirLine=[crv_3, sawl1, sawl2],
    BladeAngle=Slider(0, range=-90..90),
    Length=Slider(0, range=0..3000),
    SawKerf=Slider(3.2, range=1..20),
    Depth=Slider(19, range=1..100),
    Side=list_7,
    Extend=Slider(0, range=0..50),
    ToolNr=Slider(1, range=1..20),
    Colour=RGB(0, 191, 255))
hopcircpath = HopCircPath(
    Center=pt_3,
    Radius=Slider(25, range=1..500),
    RadiusCorr=list_5,
    Depth=Slider(10, range=1..100),
    Stepdown=Slider(0, range=0..50),
    Angle=Slider(0, range=0..360),
    ToolNr=Slider(1, range=1..20),
    Colour=RGB(50, 205, 50))
hopdrill = HopDrill(
    Points=pt_4,
    Depth=Slider(10, range=1..100),
    Diameter=Slider(8, range=1..50),
    Stepdown=Slider(0, range=0..50),
    ToolNr=Slider(1, range=1..20),
    Colour=RGB(255, 0, 0))
hopcircpocket = HopCircPocket(
    Center=pt_5,
    Radius=Slider(25, range=1..500),
    Depth=Slider(10, range=1..100),
    Stepdown=Slider(0, range=0..50),
    ToolNr=Slider(1, range=1..20),
    Colour=RGB(0, 255, 255))
hopdrillrow = HopDrillRow(
    Direction=list_8,
    StartPoint=pt_6,
    Spacings=Slider(32, range=0..500),
    Depth=Slider(13, range=1..50),
    Diameter=Slider(5, range=1..50),
    Mirror=False,
    ToolNr=Slider(1, range=1..20),
    Colour=RGB(255, 99, 71))
hopfreeslot = HopFreeSlot(
    P1=pt_7,
    P2=pt_8,
    SlotWidth=Slider(8, range=1..50),
    Depth=Slider(10, range=1..100),
    ToolNr=Slider(1, range=1..20),
    Colour=RGB(255, 165, 0))
hopfixchip = HopFixchip(Positions=pt_9, Angle=Slider(0, range=-360..360), Skippable=True)
hopengraving = HopEngraving(
    Curves=[crv_4, engravec],
    Depth=Slider(0.5, range=0.1..5),
    Tolerance=Slider(0.05, range=0.01..1),
    ToolNr=Slider(1, range=1..20),
    Colour=RGB(147, 112, 219))
hopformatcut = HopFormatCut(
    Direction=list,
    Position=pt_10,
    Thickness=Slider(19, range=1..100),
    KW=Slider(0, range=-90..90),
    Length=Slider(0, range=0..3000),
    ToolNr=Slider(1, range=1..20),
    Colour=RGB(30, 144, 255))
hopjob = HopJob(
    OperationLines=[hopdrill, hopdrillrow, hopcircpocket, hopcircpath, hoprectpocket, hopcontour, hopengraving, hopfreeslot, hopgrooveslot, hopsaw, hopformatcut, hopblumhinge, hopfixchip],
    DX=Slider(800, range=0..5000),
    DY=Slider(600, range=0..3000),
    DZ=Slider(19, range=1..100),
    WZGV="7023K_681")  # -> IsValid, Summary, Errors, Stats, HopContent
hopstocksim = HopStockSim(HopContent=hopjob.HopContent, Step=Slider(99, range=0..99))  # -> Stock, Steps, StepCount
hopbackplot = HopBackplot(HopContent=hopjob.HopContent, Show=True, TextSize=12)  # -> OpCount, ChainCount
