# Grasshopper definition first komplet test script.gh (Grasshopper 1.0.8)
# plug-ins: DYNESTIC Post-Processor, opennest_2 Info, Telepathy

number_slider = Slider(800, range=0..1000)
number_slider_2 = Slider(600, range=0..1000)

# ----
# Trigger:
toggle = BooleanToggle(True)

neg = Negative(Value=Slider(19, range=0..100))

Y = UnitY(Factor=1)
pt = Point(Point(0, 0, 0))
line = LineSDL(Start=pt, Direction=Y, Length=Slider(600, range=0..10000))
division = Division(A=number_slider, B=2)
X = UnitX(Factor=division)
move = Move(Geometry=line, Motion=X)  # -> Geometry, Transform

rectangle = Rectangle(Plane=PlaneXY(0, 0, 0), XSize=number_slider, YSize=number_slider_2, Radius=0)  # -> Rectangle, Length
Z = UnitZ(Factor=neg)
extr = Extrude(Base=rectangle.Rectangle, Direction=Z)
cap = CapHoles(Brep=extr)

neg_2 = Negative(Value=Slider(10, range=0..100))
offset = OffsetCurve(Curve=rectangle.Rectangle, Distance=neg_2, Corners=1)

crv = Curve(rectangle.Rectangle)
area = Area(Geometry=crv)  # -> Area, Centroid
division_2 = Division(A=number_slider, B=4)
X_2 = UnitX(Factor=division_2)
move_2 = Move(Geometry=area.Centroid, Motion=X_2)  # -> Geometry, Transform

# ----
# Export
# Directory:
path = FilePath("C:\Users\leona\Downloads\")

dom = ConstructDomain(DomainStart=Slider(0, range=0..100), DomainEnd=Slider(45, range=0..100))

debrep = DeconstructBrep(Brep=offset)  # -> Faces, Edges, Vertices
lng = ListLength(List=debrep.Edges)
range = Range(Domain=dom, Steps=lng)

pln = Plane(area.Centroid)
yz = YZPlane(Origin=pln)
mirror = Mirror(Geometry=move_2.Geometry, Plane=yz)  # -> Geometry, Transform

division_3 = Division(A=number_slider_2, B=Slider(3, range=0..10))
Y_2 = UnitY(Factor=division_3)
pt_2 = Point(mirror.Geometry)
move_3 = Move(Geometry=pt_2, Motion=Y_2)  # -> Geometry, Transform

division_4 = Division(A=division_2, B=2)
neg_3 = Negative(Value=division_4)
X_3 = UnitX(Factor=neg_3)
move_4 = Move(Geometry=move_3.Geometry, Motion=X_3)  # -> Geometry, Transform

X_4 = UnitX(Factor=1)
line_2 = LineSDL(Start=move_4.Geometry, Direction=X_4, Length=Slider(200, range=0..1000))

pln_2 = Plane(area.Centroid)
yz_2 = YZPlane(Origin=pln_2)
mirror_2 = Mirror(Geometry=line_2, Plane=yz_2)  # -> Geometry, Transform
divide = DivideCurve(Curve=mirror_2.Geometry, Count=10, Kinks=False)  # -> Points, Tangents, Parameters

c_script = CSharpScript(curve=line_2)  # -> out_curve, out_points; inputs curve: Curve, n: Int32, freq: Double, maxAmp: Double
# ---------- c_script: C# ----------
using System;
using System.Collections;
using System.Collections.Generic;

using Rhino;
using Rhino.Geometry;

using Grasshopper;
using Grasshopper.Kernel;
using Grasshopper.Kernel.Data;
using Grasshopper.Kernel.Types;

public class Script_Instance : GH_ScriptInstance
{
    private void RunScript(
		Curve curve,
		int n,
		double freq,
		double maxAmp,
		ref object out_curve,
		ref object out_points)
    {
        out_curve = null;
        out_points = new List<Point3d>();

        if (curve == null) return;
        if (n <= 1) n = 100;
        if (freq <= 0) freq = 5.0;
        if (maxAmp == 0) maxAmp = 50.0;

        double[] tParams = curve.DivideByCount(n, true);
        if (tParams == null || tParams.Length < 2) return;

        List<Point3d> movedPts = new List<Point3d>();

        for (int i = 0; i < tParams.Length; i++)
        {
            double t_norm = (double)i / (tParams.Length - 1);

            Point3d pt = curve.PointAt(tParams[i]);

            Vector3d tangent = curve.TangentAt(tParams[i]);
            tangent.Unitize();

            Vector3d normal = Vector3d.CrossProduct(tangent, Vector3d.ZAxis);
            normal.Unitize();

            // linear growing sine wave
            double displacement = Math.Sin(t_norm * freq * 2.0 * Math.PI) * t_norm * maxAmp;

            movedPts.Add(pt + normal * displacement);
        }

        out_points = movedPts;
        out_curve = Curve.CreateInterpolatedCurve(movedPts, 3);
    }
}
# ---------- end c_script ----------

# ----
# File Name:
panel = Panel("Test_Final_23")

brep = Brep(cap)
hopsheet = HopSheet(Geometry=brep)  # -> DX, DY, DZ, SheetCurve

list = ValueList({"Left": -1, "Center": 0, "Right": 1}, selected="Center")
hopsaw = HopSaw(
    DirLine=move.Geometry,
    BladeAngle=Slider(0, range=-90..90),
    Length=Slider(600, range=10..3000),
    SawKerf=Slider(3.2, range=1..20),
    Depth=Slider(19, range=1..100),
    Side=list,
    Extend=Slider(50, range=0..50),
    ToolNr=Slider(1, range=1..20),
    Colour=RGB(0, 191, 255))

pt_3 = Point(move_2.Geometry)
hopcircpath = HopCircPath(
    Center=pt_3,
    Radius=Slider(100, range=1..500),
    RadiusCorr=Slider(0, range=-5..5),
    Depth=Slider(10, range=1..100),
    Stepdown=Slider(2, range=0..50),
    Angle=Slider(0, range=0..360),
    ToolNr=Slider(2, range=1..20),
    Colour=RGB(50, 205, 50))

pt_4 = Point(mirror.Geometry)
hopcircpocket = HopCircPocket(
    Center=pt_4,
    Radius=Slider(100, range=1..500),
    Depth=Slider(10, range=1..100),
    Stepdown=Slider(2, range=0..50),
    ToolNr=Slider(3, range=1..20),
    Colour=RGB(0, 255, 255))

crv_2 = Curve(c_script.out_curve)
list_2 = ValueList({"Left": 1, "Center": 0, "Right": -1}, selected="Center")
hopcontour = HopContour(
    Curve=crv_2,
    Depth=Slider(10, range=1..100),
    PlungeZ=Slider(0, range=0..100),
    Tolerance=Slider(0.1, range=0.001..1),
    ToolNr=Slider(4, range=1..20),
    ToolDiameter=Slider(8, range=1..50),
    Side=list_2,
    Stepdown=Slider(0, range=0..50),
    Colour=RGB(255, 255, 0))

pt_5 = Point(divide.Points)
hopdrill = HopDrill(
    Points=pt_5,
    Depth=Slider(16, range=1..100),
    Diameter=Slider(8, range=1..50),
    Stepdown=Slider(2, range=0..50),
    ToolNr=Slider(5, range=1..20),
    Colour=RGB(255, 0, 0))

list_3 = ValueList({"Left": -1, "Center": 0, "Right": 1}, selected="Left")
hopsaw_2 = HopSaw(
    DirLine=debrep.Edges,
    BladeAngle=range,
    Length=Slider(600, range=10..3000),
    SawKerf=Slider(3.2, range=1..20),
    Depth=Slider(19, range=1..100),
    Side=list_3,
    Extend=Slider(50, range=0..50),
    ToolNr=Slider(8, range=1..20),
    Colour=RGB(0, 191, 255))

Y_3 = UnitY(Factor=Slider(50, range=0..100))

pln_3 = Plane(area.Centroid)

neg_4 = Negative(Value=Slider(25, range=0..100))
Y_4 = UnitY(Factor=neg_4)

neg_5 = Negative(Value=Slider(21, range=0..100))
Y_5 = UnitY(Factor=neg_5)

xz = XZPlane(Origin=pln_3)

mirror_3 = Mirror(Geometry=mirror_2.Geometry, Plane=xz)  # -> Geometry, Transform

pln_4 = Plane(area.Centroid)
yz_3 = YZPlane(Origin=pln_4)

end = EndPoints(Curve=mirror_3.Geometry)  # -> Start, End

move_5 = Move(Geometry=end.End, Motion=Y_3)  # -> Geometry, Transform

rec_3pt = Rectangle3Pt(PointA=end.Start, PointB=end.End, PointC=move_5.Geometry)  # -> Rectangle, Length

move_6 = Move(Geometry=rec_3pt.Rectangle, Motion=Y_4)  # -> Geometry, Transform

mirror_4 = Mirror(Geometry=move_6.Geometry, Plane=yz_3)  # -> Geometry, Transform

debrep_2 = DeconstructBrep(Brep=mirror_4.Geometry)  # -> Faces, Edges, Vertices
item = ListItem(List=debrep_2.Vertices, Index=Slider(3, range=0..10), Wrap=True)
move_7 = Move(Geometry=item, Motion=Y_5)  # -> Geometry, Transform

text = Text(
    Location=move_7.Geometry,
    Text="Klarheit entsteht durch Machen, nicht durch Denken.",
    Size=Slider(0.071, range=0..0.1),
    Font="SLF-RHN Architect")

crv_3 = Curve(move_6.Geometry)
hoprectpocket = HopRectPocket(
    RectCurve=crv_3,
    CornerRadius=Slider(10, range=0..50),
    Angle=Slider(0, range=0..360),
    Depth=Slider(10, range=1..100),
    Stepdown=Slider(3, range=0..50),
    ToolNr=Slider(6, range=1..20),
    Colour=RGB(0, 255, 255))

crv_4 = Curve(text)
hopengraving = HopEngraving(
    Curves=crv_4,
    Depth=Slider(0.4, range=0.1..5),
    Tolerance=Slider(0.05, range=0.01..1),
    ToolNr=Slider(7, range=1..20),
    Colour=RGB(147, 112, 219))

entwine = Entwine(
    Branch00=hopsaw,
    Branch01=hopcircpath,
    Branch02=hopcircpocket,
    Branch03=hopcontour,
    Branch04=hopdrill,
    Branch05=hoprectpocket,
    Branch06=hopengraving,
    Branch07=hopsaw_2,
    FlattenInputs=True)  # -> flatten(Result)
operationlines = RemoteSender(entwine)

operationlines_2 = RemoteReceiver(operationlines)
hopexport = HopExport(
    Folder=path,
    FileName=panel,
    Export=toggle,
    DX=hopsheet.DX,
    DY=hopsheet.DY,
    DZ=hopsheet.DZ,
    WZGV="7023K_681",
    OperationLines=operationlines_2)  # -> HopContent, StatusMsg

hopanalyzer = HopAnalyzer(HopContent=hopexport.HopContent, Run=Toggle(True))  # -> IsValid, ErrorCount, Errors, Summary

panel_2 = Panel(hopanalyzer.IsValid)
panel_3 = Panel(hopanalyzer.ErrorCount)
panel_4 = Panel(hopanalyzer.Errors)
panel_5 = Panel(hopanalyzer.Summary)
