# Grasshopper definition cabinet.gh (Grasshopper 1.0.8)
# plug-ins: DYNESTIC Post-Processor

list = ValueList({"Zum Schrauben (Ø4mm, 10mm)": 0, "Zum Einpressen (Ø10mm, 12mm)": 1}, selected="Zum Schrauben (Ø4mm, 10mm)")
hopfeet = HopFeet(Variant=list, FootOffset=Slider(50, range=33..100), SockelHeight=Slider(100, range=50..300))

list_2 = ValueList({"1 Tür": 1, "2 Türen": 2}, selected="1 Tür")
list_3 = ValueList({"Vollanschlag (Full Overlay)": 0, "Halbeinschlag (Half Overlay)": 1, "Einliegend (Inset)": 2}, selected="Vollanschlag (Full Overlay)")
list_4 = ValueList({"Blum Clip Top": 0, "Häfele Duomatic": 1}, selected="Blum Clip Top")
list_5 = ValueList({"Links (Left)": 0, "Rechts (Right)": 1, "Mitte (Center, for 2-door)": 2}, selected="Links (Left)")
hopcabinetdoor = HopCabinetDoor(Count=list_2, Overlay=list_3, HingeType=list_4, HingeSide=list_5, Gap=Slider(2, range=0..5))

list_6 = ValueList({"Eingefälzt (Falznut)": 1, "Eingenutert (Nut)": 2}, selected="Eingefälzt (Falznut)")
hopcabinetback = HopCabinetBack(Type=list_6, Thickness=Slider(8, range=3..25), Tiefe=Slider(10, range=6..15), Reststeg=Slider(19, range=6..50))  # -> BackData, Reststeg

list_7 = ValueList({"Holzdübel 8×30": 0, "Holzdübel 8×40": 1, "Cabineo 8": 2, "Clamex P-14": 3, "Nesting-Dübel": 4}, selected="Holzdübel 8×30")
hopconnector = HopConnector(Type=list_7, AutoCount=Toggle(False), Count=Slider(2, range=1..6))

hopshelves = HopShelves(Count=Slider(3, range=0..10))

hopkorpus = HopKorpus(
    Width=Slider(600, range=100..2400),
    Height=Slider(1279, range=100..2400),
    Depth=Slider(375, range=100..800),
    Thickness=Slider(19, range=8..38),
    Type="Cabinet",
    Colour=RGB(180, 140, 100),
    Back=hopcabinetback.BackData,
    Connectors=hopconnector,
    Shelves=hopshelves,
    Feet=hopfeet,
    Door=hopcabinetdoor,
    DrillToolNr=Slider(1, range=1..20),
    RouterToolNr=Slider(0, range=0..20))  # -> CabinetData, Panels, AssembledBreps

path = FilePath("D:\Projekte\SynologyDrive\53_post-processor\test\")

hopmateriallist = HopMaterialList(Parts=hopkorpus.Panels)  # -> MaterialList, TotalAreaM2
panel = Panel(hopmateriallist.MaterialList)

hoppartexport = HopPartExport(
    Parts=hopkorpus.Panels,
    Folder=path,
    CabinetData=hopkorpus.CabinetData,
    CorpusNr=Slider(11, range=1..99),
    WZGV="7023K_681",
    DZ=Slider(19, range=1..200),
    Export=Toggle(True))  # -> FilePaths, StatusMsg

path_2 = FilePath("E:\Rhino Resourcen\Plan Köpfe\Leonard Elias Böker.3dm")
path_3 = FilePath(path)
hopdrawing = HopDrawing(
    Geometry=hopkorpus.AssembledBreps,
    Parts=hopkorpus.Panels,
    TemplatePath=path_2,
    ProjectName="Projekt",
    Scale=Slider(10, range=5..50),
    LayoutName="Grundriss_01",
    Folder=path_3,
    Generate=Toggle(True))  # -> MaterialList, StatusMsg
